vi "Close Config File.gvi"   [LabVIEW NXG 3.0.0]
# Use this VI to close the reference to the configuration file.
# This VI executes regardless of an incoming error.
inputs:
  "Dam in": "Dam.gtype", required
  "Error in": error
outputs:
  "File Path": path
  "Dam out": "Dam.gtype"
  "Error out": error
diagram:
  Property Node(instance in=$"Dam in") -> ("Backup"=w1, error out=w2, instance out=w3)
  $"Dam out" <- w3
  Property Node(instance in=w1) -> ("File Path"=w4, "refnum"=w5)
  Close File(error in=w2, refnum=w5) -> (error out=w6)
  Merge Errors($"Error in", w6) -> (error out=w7)
  $"Error out" <- w7
  $"File Path" <- w4
