vi "Close.gvi"   [LabVIEW NXG 3.0.0]
# Use this VI to close references needed by the dam.
# This VI executes regardless of any incoming error.
inputs:
  "Dam in": "Dam.gtype", required
  "Error in": error
outputs:
  "Error out": error
uses:
  Dam.gtype::Get Dams Data.gvi
  Dam.gtype::Write Config File.gvi
  Dam.gtype::Read Config File.gvi
  Dam.gtype::Close Config File.gvi
  Report.gtype::Close.gvi
  Turbine.gtype::Close.gvi
  Floodgate.gtype::Close.gvi
  NI::G Core::Error::Build Error Cluster.gvi
  Lake.gtype::Close.gvi
  NI::G Core::Error::Multiplex Errors.gvi
diagram:
  call "Get Dams Data.gvi"(Dam in=$"Dam in") -> (Dam out=w1, Dam's data=w2, Error out=w3)
  call "Write Config File.gvi"(Dam in=w1, Report Data=w2, Error in=w3) -> (Dam out=w4, Error out=w5)
  call "Read Config File.gvi"(Dam in=w4, Error in=w5) -> (Dam out=w6, Dam Data Out=w7, Error out=w8)
  call "Close Config File.gvi"(Dam in=w6, Error in=w8) -> (Dam out=w9, Error out=w10)
  Property Node(instance in=w9) -> ("Lake"=w11, "Large floodgates"=w12, "Small floodgates"=w13, "Turbines"=w14, "Report"=w15, error out=w16)
  call "Close.gvi"(Report in=w15, Error in=w16) -> (Error out=w17)
  for {
    w18 = each element of w14
    call "Close.gvi"(Turbine in=w18, Error in=w16) -> (Error out=w20)
    append w20 to w19
  }
  for {
    w21 = each element of w13
    call "Close.gvi"(Floodgate in=w21, Error in=w16) -> (Error out=w23)
    append w23 to w22
  }
  Is Equal[ComparisonMode=CompareAggregates](x=w2, y=w7) -> w24
  case (w24) {
    frame False, Default {
      # Run this case if the last status is not the
      # same for the read and write of the config file
      call "Build Error Cluster.gvi"(error in=w10, code=5001, description="Did not backup the dam's last state successfully.") -> (error out=w25)
    }
    frame True {
      w25 = w10
    }
  }
  call "Close.gvi"(Lake in=w11, Error in=w16) -> (Error out=w26)
  for {
    w27 = each element of w12
    call "Close.gvi"(Floodgate in=w27, Error in=w16) -> (Error out=w29)
    append w29 to w28
  }
  call "Multiplex Errors.gvi"(error in 1=$"Error in", error in 2=w25, error in 3=w26, error array in=w28) -> (error out=w30)
  call "Multiplex Errors.gvi"(error in 1=w30, error array in=w22) -> (error out=w31)
  call "Multiplex Errors.gvi"(error in 1=w31, error in 2=w17, error array in=w19) -> (error out=w32)
  $"Error out" <- w32
