vi "Default Settings.gvi"   [LabVIEW NXG 3.0.0]
# This VI holds the constants used in the dam. Modify this VI if you want different reset constants.
outputs:
  "Output": "Report Data.gtype"
types:
  "Lake properties.gtype" = cluster{"Lake Fill (Acre-feet)": f64, "Lake Intake Rate (cfs)": f64, "Lake Discharge Rate (cfs)": f64}
  "Large Floodgates properties.gtype" = cluster{"# of Large Floodgates": i32, "Large Flodgates Size (cfs)": f64, "Large Floodgates Status": bool[]}
  "Small Floodgates properties.gtype" = cluster{"# of Small Floodgates": i32, "Small Floodgates Size (cfs)": f64, "Small Floodgates Status": bool[]}
  "Turbines properties.gtype" = cluster{"# of Turbines": i32, "Power at Max Flow (MW)": f64, "Turbine Gates Status": bool[], "Turbines State (%)": f64[], "Total Power Being Generated (MW)": f64, "Max Flow (cfs)": f64}
  "Report Data.gtype" = cluster{"Lake properties": "Lake properties.gtype", "Large Floodgates properties": "Large Floodgates properties.gtype", "Small Floodgates properties": "Small Floodgates properties.gtype", "Turbines properties": "Turbines properties.gtype"}
diagram:
  w1 = "Report Data.gtype" {"Lake properties"={"Lake Fill (Acre-feet)"=1100000, "Lake Intake Rate (cfs)"=1000, "Lake Discharge Rate (cfs)"=0}, "Large Floodgates properties"={"# of Large Floodgates"=4, "Large Flodgates Size (cfs)"=15300, "Large Floodgates Status"=[]}, "Small Floodgates properties"={"# of Small Floodgates"=5, "Small Floodgates Size (cfs)"=8600, "Small Floodgates Status"=[]}, "Turbines properties"={"# of Turbines"=2, "Power at Max Flow (MW)"=8.5, "Turbine Gates Status"=[], "Turbines State (%)"=[], "Total Power Being Generated (MW)"=0, "Max Flow (cfs)"=1750}}  # Default Data
  Property Node(instance in=w1) -> ("Large Floodgates properties"=w2, "Small Floodgates properties"=w3, "Turbines properties"=w4, instance out=w5)
  Property Node(instance in=w2) -> ("# of Large Floodgates"=w6, instance out=w7)
  Initialize Array(element=FALSE, size=w6) -> w8
  Property Node(instance in=w7, "Large Floodgates Status"=w8) -> (instance out=w9)
  Property Node(instance in=w3) -> ("# of Small Floodgates"=w10, instance out=w11)
  Initialize Array(element=FALSE, size=w10) -> w12
  Property Node(instance in=w11, "Small Floodgates Status"=w12) -> (instance out=w13)
  Property Node(instance in=w4) -> ("# of Turbines"=w14, instance out=w15)
  Initialize Array(element=TRUE, size=w14) -> w16
  Initialize Array(element=100, size=w14) -> w17
  Property Node(instance in=w15, "Turbine Gates Status"=w16, "Turbines State (%)"=w17) -> (instance out=w18)
  Property Node(instance in=w5, "Large Floodgates properties"=w9, "Small Floodgates properties"=w13, "Turbines properties"=w18) -> (instance out=w19)
  $Output <- w19
