vi "Get Dams Data.gvi"   [LabVIEW NXG 3.0.0]
# Use this VI to retrieve the dam’s internal data
inputs:
  "Dam in": "Dam.gtype", required
  "Error in": error
outputs:
  "Dam's data": "Report Data.gtype"
  "Dam out": "Dam.gtype"
  "Error out": error
types:
  "Lake properties.gtype" = cluster{"Lake Fill (Acre-feet)": f64, "Lake Intake Rate (cfs)": f64, "Lake Discharge Rate (cfs)": f64}
  "Large Floodgates properties.gtype" = cluster{"# of Large Floodgates": i32, "Large Flodgates Size (cfs)": f64, "Large Floodgates Status": bool[]}
  "Small Floodgates properties.gtype" = cluster{"# of Small Floodgates": i32, "Small Floodgates Size (cfs)": f64, "Small Floodgates Status": bool[]}
  "Turbines properties.gtype" = cluster{"# of Turbines": i32, "Power at Max Flow (MW)": f64, "Turbine Gates Status": bool[], "Turbines State (%)": f64[], "Total Power Being Generated (MW)": f64}
  "Report Data.gtype" = cluster{"Lake properties": "Lake properties.gtype", "Large Floodgates properties": "Large Floodgates properties.gtype", "Small Floodgates properties": "Small Floodgates properties.gtype", "Turbines properties": "Turbines properties.gtype"}
uses:
  Turbine.gtype::Read Generated Power.gvi
  Floodgate.gtype::Get Discharge.gvi
  Lake.gtype::Read Lake Level.gvi
diagram:
  w1 = "Report Data.gtype" {"Lake properties"={"Lake Fill (Acre-feet)"=0, "Lake Intake Rate (cfs)"=0, "Lake Discharge Rate (cfs)"=0}, "Large Floodgates properties"={"# of Large Floodgates"=4, "Large Flodgates Size (cfs)"=0, "Large Floodgates Status"=[]}, "Small Floodgates properties"={"# of Small Floodgates"=5, "Small Floodgates Size (cfs)"=0, "Small Floodgates Status"=[]}, "Turbines properties"={"# of Turbines"=2, "Power at Max Flow (MW)"=0, "Turbine Gates Status"=[], "Turbines State (%)"=[], "Total Power Being Generated (MW)"=0}}  # Report Data
  case ($"Error in") {
    frame No Error {
      Property Node(instance in=$"Dam in", error in=$"Error in") -> ("Lake"=w5, "Large floodgates"=w6, "Small floodgates"=w7, "Turbines"=w8, error out=w9, instance out=w10)
      s1 = w9  # shift register
      for (N -> w11) {
        w12 = each element of w8
        call "Read Generated Power.gvi"(Turbine in=w12, Error in=s1) -> (Power at Max Flow (MW)=w17, Open Percentage (%)=w18, Turbine out=w19, Power Generated (MW)=w20, Gate State (FALSE = Closed)=w21, Error out=w22)
        append w19 to w13
        append w21 to w14
        append w18 to w15
        append w20 to w16
        next s1 = w22
      }
      s2 = w9  # shift register
      for (N -> w23) {
        w24 = each element of w6
        call "Get Discharge.gvi"(Floodgate in=w24, Error in=s2) -> (Size (cfs)=w27, Floodgate out=w28, Open?=w29, Error out=w30)
        append w28 to w25
        append w29 to w26
        next s2 = w30
      }
      s3 = w9  # shift register
      for (N -> w31) {
        w32 = each element of w7
        call "Get Discharge.gvi"(Floodgate in=w32, Error in=s3) -> (Size (cfs)=w35, Floodgate out=w36, Open?=w37, Error out=w38)
        append w36 to w33
        append w37 to w34
        next s3 = w38
      }
      call "Read Lake Level.gvi"(Lake in=w5, Error in=w9) -> (Intake Rate (cfs)=w39, Discharge Rate (cfs)=w40, Lake out=w41, Fill (Acre-feet)=w42, Error out=w43)
      Add Array Elements(numeric array=w16) -> (sum=w44)
      in-place (after w1) {
        Unbundle Bundle Read Poser() -> ("Lake properties"=w45, "Large Floodgates properties"=w46, "Small Floodgates properties"=w47, "Turbines properties"=w48)
        Property Node(instance in=w48, "# of Turbines"=w11, "Power at Max Flow (MW)"=w17, "Turbine Gates Status"=w14, "Turbines State (%)"=w15, "Total Power Being Generated (MW)"=w44) -> (instance out=w49)
        Property Node(instance in=w46, "# of Large Floodgates"=w23, "Large Flodgates Size (cfs)"=w27, "Large Floodgates Status"=w26) -> (instance out=w50)
        Property Node(instance in=w47, "# of Small Floodgates"=w31, "Small Floodgates Size (cfs)"=w35, "Small Floodgates Status"=w34) -> (instance out=w51)
        Property Node(instance in=w45, "Lake Fill (Acre-feet)"=w42, "Lake Intake Rate (cfs)"=w39, "Lake Discharge Rate (cfs)"=w40) -> (instance out=w52)
        Unbundle Bundle Write Poser("Lake properties"=w52, "Large Floodgates properties"=w50, "Small Floodgates properties"=w51, "Turbines properties"=w49)
        w4 = _
      }
      Merge Errors(w43, s2, s3, s1) -> (error out=w53)
      Property Node(instance in=w10, "Lake"=w41, "Large floodgates"=w25, "Small floodgates"=w33, "Turbines"=w13, error in=w53) -> (error out=w2, instance out=w3)
    }
    frame Error {
      w2 = $"Error in"
      w3 = $"Dam in"
      w4 = default
    }
  }
  $"Dam's data" <- w4
  $"Dam out" <- w3
  $"Error out" <- w2
