vi "Init.gvi"   [LabVIEW NXG 3.0.0]
# This VI creates a dam based on it’s last logged state in the status backup input. You can also initialize the log using the Log Path In input.
inputs:
  "Log Path In": path
  "Reset?": bool
  "Error in": error
  "Status backup": path
outputs:
  "Log Path Out": path
  "Dam out": "Dam.gtype"
  "Error out": error
  "Dam's Max Power Output": f64
  "Dam's data": "Report Data.gtype"
types:
  "Lake properties.gtype" = cluster{"Lake Fill (Acre-feet)": f64, "Lake Intake Rate (cfs)": f64, "Lake Discharge Rate (cfs)": f64}
  "Large Floodgates properties.gtype" = cluster{"# of Large Floodgates": i32, "Large Flodgates Size (cfs)": f64, "Large Floodgates Status": bool[]}
  "Small Floodgates properties.gtype" = cluster{"# of Small Floodgates": i32, "Small Floodgates Size (cfs)": f64, "Small Floodgates Status": bool[]}
  "Turbines properties.gtype" = cluster{"# of Turbines": i32, "Power at Max Flow (MW)": f64, "Turbine Gates Status": bool[], "Turbines State (%)": f64[], "Total Power Being Generated (MW)": f64, "Max Flow (cfs)": f64}
  "Report Data.gtype" = cluster{"Lake properties": "Lake properties.gtype", "Large Floodgates properties": "Large Floodgates properties.gtype", "Small Floodgates properties": "Small Floodgates properties.gtype", "Turbines properties": "Turbines properties.gtype"}
uses:
  Dam.gtype::Open Config File.gvi
  Dam.gtype::Read Config File.gvi
  Turbine.gtype::Init.gvi
  Turbine.gtype::Read Generated Power.gvi
  Floodgate.gtype::Init.gvi
  Floodgate.gtype::Get Discharge.gvi
  Lake.gtype::Init.gvi
  Lake.gtype::Add Discharge.gvi
  Report.gtype::Open or Create.gvi
  Dam.gtype::Get Dams Data.gvi
diagram:
  w1 = "Report Data.gtype" {"Lake properties"={"Lake Fill (Acre-feet)"=1100000, "Lake Intake Rate (cfs)"=1000, "Lake Discharge Rate (cfs)"=0}, "Large Floodgates properties"={"# of Large Floodgates"=4, "Large Flodgates Size (cfs)"=15300, "Large Floodgates Status"=[]}, "Small Floodgates properties"={"# of Small Floodgates"=5, "Small Floodgates Size (cfs)"=8600, "Small Floodgates Status"=[]}, "Turbines properties"={"# of Turbines"=2, "Power at Max Flow (MW)"=8.5, "Turbine Gates Status"=[], "Turbines State (%)"=[], "Total Power Being Generated (MW)"=0, "Max Flow (cfs)"=1750}}  # Default Data
  Property Node(instance in=w1) -> ("Large Floodgates properties"=w2, "Small Floodgates properties"=w3, "Turbines properties"=w4, instance out=w5)
  Property Node(instance in=w2) -> ("# of Large Floodgates"=w6, instance out=w7)
  Initialize Array(element=FALSE, size=w6) -> w8
  Property Node(instance in=w7, "Large Floodgates Status"=w8) -> (instance out=w9)
  Property Node(instance in=w3) -> ("# of Small Floodgates"=w10, instance out=w11)
  Initialize Array(element=FALSE, size=w10) -> w12
  Property Node(instance in=w11, "Small Floodgates Status"=w12) -> (instance out=w13)
  Property Node(instance in=w4) -> ("# of Turbines"=w14, instance out=w15)
  Initialize Array(element=TRUE, size=w14) -> w16
  Initialize Array(element=100, size=w14) -> w17
  Property Node(instance in=w15, "Turbine Gates Status"=w16, "Turbines State (%)"=w17) -> (instance out=w18)
  Property Node(instance in=w5, "Large Floodgates properties"=w9, "Small Floodgates properties"=w13, "Turbines properties"=w18) -> (instance out=w19)
  # Lake discharge is calculated when the application starts,
  # so we make sure we have the correct amount
  case ($"Error in") {
    frame No Error {
      call "Open Config File.gvi"(Dam in="Dam.gtype" constant, Status backup=$"Status backup", Error in=$"Error in") -> (Dam out=w25, Error out=w26)
      # w27: If there is an error in the file read or reset is TRUE: pre-load the defaults
      call "Read Config File.gvi"(Dam in=w25, Dam Data In=w19, Error in=w26) -> (Dam out=w28, Dam Data Out=w29, Error out=w27)
      Logical Or($"Reset?", w27) -> w30
      Select(s=w30, t=w19, f=w29) -> w31
      Property Node(instance in=w31) -> ("Lake properties"=w32, "Large Floodgates properties"=w33, "Small Floodgates properties"=w34, "Turbines properties"=w35)
      Property Node(instance in=w35) -> ("# of Turbines"=w36, "Power at Max Flow (MW)"=w37, "Turbine Gates Status"=w38, "Turbines State (%)"=w39, "Max Flow (cfs)"=w40)
      s1 = w26  # shift register
      for (N = w36) (iteration -> i1) {
        Array Index(array=w38) -> (out0[i1]=w44)
        Array Index(array=w39) -> (out0[i1]=w45)
        call "Init.gvi"(Power at Max Flow (MW)=w37, Gate State (FALSE = Closed)=w44, Open Percentage (%)=w45, Error in=s1, Max Flow (cfs)=w40) -> (Turbine out=w46, Error out=w47)
        call "Read Generated Power.gvi"(Turbine in=w46, Error in=w47) -> (Turbine out=w48, Error out=w49, Flow (cfs)=w50)
        append w48 to w41
        append w37 to w42
        append w50 to w43
        next s1 = w49
      }
      Property Node(instance in=w33) -> ("# of Large Floodgates"=w51, "Large Flodgates Size (cfs)"=w52, "Large Floodgates Status"=w53)
      s2 = w26  # shift register
      for (N = w51) (iteration -> i2) {
        Array Index(array=w53) -> (out0[i2]=w56)
        call "Init.gvi"(Size (cfs)=w52, State (FALSE = Closed)=w56, Error in=s2) -> (Floodgate out=w57, Error out=w58)
        call "Get Discharge.gvi"(Floodgate in=w57, Error in=w58) -> (Floodgate out=w59, Discharge (cfs)=w60, Error out=w61)
        append w59 to w54
        append w60 to w55
        next s2 = w61
      }
      Property Node(instance in=w34) -> ("# of Small Floodgates"=w62, "Small Floodgates Size (cfs)"=w63, "Small Floodgates Status"=w64)
      s3 = w26  # shift register
      for (N = w62) (iteration -> i3) {
        Array Index(array=w64) -> (out0[i3]=w67)
        call "Init.gvi"(Size (cfs)=w63, State (FALSE = Closed)=w67, Error in=s3) -> (Floodgate out=w68, Error out=w69)
        call "Get Discharge.gvi"(Floodgate in=w68, Error in=w69) -> (Floodgate out=w70, Discharge (cfs)=w71, Error out=w72)
        append w70 to w65
        append w71 to w66
        next s3 = w72
      }
      Property Node(instance in=w32) -> ("Lake Fill (Acre-feet)"=w73, "Lake Intake Rate (cfs)"=w74)
      call "Init.gvi"(Fill (Acre-feet)=w73, Intake Rate (cfs)=w74, Discharge Rate (cfs)=0, Error in=w26) -> (Lake out=w75, Error out=w76)
      Add Array Elements(numeric array=w43) -> (sum=w77)
      call "Add Discharge.gvi"(Lake in=w75, Add Discharge Rate (cfs)=w77, Error in=w76) -> (Lake out=w78, Error out=w79)
      call "Open or Create.gvi"(Log Path In=$"Log Path In", Error in=w26) -> (Report out=w80, Log Path Out=w22, Error out=w81)
      Merge Errors(w79, s2, s3, s1, w81) -> (error out=w82)
      Property Node(instance in=w28, "Lake"=w78, "Turbines"=w41, "Large floodgates"=w54, "Small floodgates"=w65, "Report"=w80, error in=w82) -> (error out=w83, instance out=w84)
      call "Get Dams Data.gvi"(Dam in=w84, Error in=w83) -> (Dam out=w21, Dam's data=w24, Error out=w20)
      Add Array Elements(numeric array=w55) -> (sum=w85)
      Add Array Elements(numeric array=w66) -> (sum=w86)
      Add Array Elements(numeric array=w42) -> (sum=w87)
      Add(w85, w86, w87) -> w23
    }
    frame Error {
      w20 = $"Error in"
      w21 = "Dam.gtype" constant
      w22 = default
      w23 = default
      w24 = default
    }
  }
  $"Dam's Max Power Output" <- w23
  $"Dam out" <- w21
  $"Dam's data" <- w24
  $"Error out" <- w20
  $"Log Path Out" <- w22
