vi "Log Status.gvi"   [LabVIEW NXG 3.0.0]
# This VI asks the Dam’s report to save the current status.
inputs:
  "Dam in": "Dam.gtype", required
  "Error in": error
outputs:
  "Dam out": "Dam.gtype"
  "Error out": error
uses:
  Dam.gtype::Get Dams Data.gvi
  Report.gtype::Write Status.gvi
diagram:
  case ($"Error in") {
    frame No Error {
      call "Get Dams Data.gvi"(Dam in=$"Dam in", Error in=$"Error in") -> (Dam out=w3, Dam's data=w4, Error out=w5)
      Property Node(instance in=w3, error in=w5) -> ("Report"=w6, error out=w7, instance out=w8)
      call "Write Status.gvi"(Report in=w6, Report Data=w4, Error in=w7) -> (Report out=w9, Error out=w10)
      Property Node(instance in=w8, "Report"=w9, error in=w10) -> (error out=w1, instance out=w2)
    }
    frame Error {
      w1 = $"Error in"
      w2 = $"Dam in"
    }
  }
  $"Dam out" <- w2
  $"Error out" <- w1
