vi "Open Config File.gvi"   [LabVIEW NXG 3.0.0]
# This VI opens a reference to the configuration file that holds the dam’s data
inputs:
  "Status backup": path
  "Dam in": "Dam.gtype", required
  "Error in": error
outputs:
  "Dam out": "Dam.gtype"
  "Error out": error
uses:
  NI::G Core::File IO (General)::Get System Directory.gvi
diagram:
  case ($"Error in") {
    frame No Error {
      Property Node(instance in=$"Dam in", error in=$"Error in") -> ("Backup"=w3, error out=w4, instance out=w5)
      Is Empty String Or Path(string/path=$"Status backup") -> w6
      Is Not A Number Or Path Or Refnum(number=$"Status backup") -> w7
      Logical Or(w6, w7) -> w8
      case (w8) {
        frame False, Default {
          w9 = $"Status backup"
        }
        frame True {
          call "Get System Directory.gvi"(type="Public Documents", create directory if not found?=FALSE) -> (system directory=w10)
          Build Path(base path=w10, name or relative path="Dam_Config.txt") -> (appended path=w9)
        }
      }
      Open Or Create Or Replace File(error in=w4, file path (use dialog)=w9, operation (0:open)="open or create") -> (error out=w11, refnum out=w12)
      Property Node(instance in=w3, "File Path"=w9, "refnum"=w12) -> (instance out=w13)
      Property Node(instance in=w5, "Backup"=w13, error in=w11) -> (error out=w1, instance out=w2)
    }
    frame Error {
      w1 = $"Error in"
      w2 = $"Dam in"
    }
  }
  $"Dam out" <- w2
  $"Error out" <- w1
