vi "Overwrite Config File.gvi"   [LabVIEW NXG 3.0.0]
# Use this VI to log the status of the dam to its config file
inputs:
  "Dam in": "Dam.gtype", required
  "Error in": error
outputs:
  "Dam out": "Dam.gtype"
  "Error out": error
diagram:
  case ($"Error in") {
    frame No Error {
      Property Node(instance in=$"Dam in", error in=$"Error in") -> ("Backup"=w3, error out=w4, instance out=w5)
      Property Node(instance in=w3) -> ("File Path"=w6, "refnum"=w7, instance out=w8)
      Close File(error in=w4, refnum=w7) -> (error out=w9)
      Open Or Create Or Replace File(error in=w9, file path (use dialog)=w6, operation (0:open)="replace or create") -> (error out=w10, refnum out=w11)
      call "Write Config File.gvi"(dam.gtype out=w5, TXT refnum in=w11, error in=w10) -> (dam.gtype in=w12, TXT refnum out=w13, error out=w14)
      Property Node(instance in=w8, "refnum"=w13) -> (instance out=w15)
      Property Node(instance in=w12, "Backup"=w15, error in=w14) -> (error out=w1, instance out=w2)
    }
    frame Error {
      w1 = $"Error in"
      w2 = $"Dam in"
    }
  }
  $"Dam out" <- w2
  $"Error out" <- w1
