vi "Read Config File.gvi"   [LabVIEW NXG 3.0.0]
# Use this VI to log the status of the dam to its config file
inputs:
  "Dam Data In": "Report Data.gtype" = {"Lake properties"={"Lake Fill (Acre-feet)"=0, "Lake Intake Rate (cfs)"=0, "Lake Discharge Rate (cfs)"=0}, "Large Floodgates properties"={"# of Large Floodgates"=4, "Large Flodgates Size (cfs)"=0, "Large Floodgates Status"=[]}, "Small Floodgates properties"={"# of Small Floodgates"=5, "Small Floodgates Size (cfs)"=0, "Small Floodgates Status"=[]}, "Turbines properties"={"# of Turbines"=2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}}
  "Dam in": "Dam.gtype", required
  "Error in": error
outputs:
  "Dam Data Out": "Report Data.gtype"
  "Dam out": "Dam.gtype"
  "Error out": error
types:
  "Lake properties.gtype" = cluster{"Lake Fill (Acre-feet)": f64, "Lake Intake Rate (cfs)": f64, "Lake Discharge Rate (cfs)": f64}
  "Large Floodgates properties.gtype" = cluster{"# of Large Floodgates": i32, "Large Flodgates Size (cfs)": f64, "Large Floodgates Status": bool[]}
  "Small Floodgates properties.gtype" = cluster{"# of Small Floodgates": i32, "Small Floodgates Size (cfs)": f64, "Small Floodgates Status": bool[]}
  "Turbines properties.gtype" = cluster{"# of Turbines": i32, "Power at Max Flow (MW)": f64, "Turbine Gates Status": bool[], "Turbines State (%)": f64[], "Total Power Being Generated (MW)": f64, "Max Flow (cfs)": f64}
  "Report Data.gtype" = cluster{"Lake properties": "Lake properties.gtype", "Large Floodgates properties": "Large Floodgates properties.gtype", "Small Floodgates properties": "Small Floodgates properties.gtype", "Turbines properties": "Turbines properties.gtype"}
diagram:
  case ($"Error in") {
    frame No Error {
      Property Node(instance in=$"Dam in", error in=$"Error in") -> ("Backup"=w4, error out=w5, instance out=w6)
      Property Node(instance in=w4) -> ("refnum"=w7, instance out=w8)
      Set File Position(error in=w5, refnum=w7) -> (error out=w9, refnum out=w10)
      Read From Text File(error in=w9, file (use dialog)=w10) -> (error out=w11, refnum out=w12, text=w13)
      Property Node(instance in=w8, "refnum"=w12) -> (instance out=w14)
      Unflatten From JSON(JSON string=w13, error in (no error)=w11, type and defaults=$"Dam Data In") -> (error out=w15, value=w3)
      Property Node(instance in=w6, "Backup"=w14, error in=w15) -> (error out=w1, instance out=w2)
    }
    frame Error {
      w1 = $"Error in"
      w2 = $"Dam in"
      w3 = $"Dam Data In"
    }
  }
  $"Dam Data Out" <- w3
  $"Dam out" <- w2
  $"Error out" <- w1
