vi "Set Floodgates Status.gvi"   [LabVIEW NXG 3.0.0]
# Use this VI to set the dam’s floodgates status
inputs:
  "Small Floodgates Status": bool[] = [FALSE, FALSE, FALSE, FALSE], required
  "Large Floodgates Status": bool[] = [FALSE, FALSE, FALSE, FALSE], required
  "Dam in": "Dam.gtype", required
  "Error in": error
outputs:
  "Large Floodgates Status Out": bool[]
  "Dam out": "Dam.gtype"
  "Error out": error
  "Small Floodgates Status Out": bool[]
uses:
  Floodgate.gtype::Get Discharge.gvi
  Floodgate.gtype::Close Gate.gvi
  Floodgate.gtype::Open Gate.gvi
  Lake.gtype::Remove Discharge.gvi
  Lake.gtype::Add Discharge.gvi
diagram:
  case ($"Error in") {
    frame No Error {
      Property Node(instance in=$"Dam in", error in=$"Error in") -> ("Lake"=w5, "Large floodgates"=w6, "Small floodgates"=w7, error out=w8, instance out=w9)
      for (iteration -> i1) {
        w10 = each element of w6
        call "Get Discharge.gvi"(Floodgate in=w10, Error in=w8) -> (Floodgate out=w14, Discharge (cfs)=w15, Error out=w16)
        Array Index(array=$"Large Floodgates Status") -> (out0[i1]=w17)
        case (w17) {
          frame False, Default {
            call "Close Gate.gvi"(Floodgate in=w14, Error in=w16) -> (Floodgate out=w19, Error out=w18)
            w20 = w17
          }
          frame True {
            call "Open Gate.gvi"(Floodgate in=w14, Error in=w16) -> (Floodgate out=w19, Error out=w18)
            w20 = w17
          }
        }
        call "Get Discharge.gvi"(Floodgate in=w19, Error in=w18) -> (Discharge (cfs)=w21)
        append w19 to w11
        append w20 to w4
        append w15 to w12
        append w21 to w13
      }
      for (iteration -> i2) {
        w22 = each element of w7
        call "Get Discharge.gvi"(Floodgate in=w22, Error in=w8) -> (Discharge (cfs)=w26, Error out=w27)
        Array Index(array=$"Small Floodgates Status") -> (out0[i2]=w28)
        case (w28) {
          frame False, Default {
            call "Close Gate.gvi"(Floodgate in=w22, Error in=w27) -> (Floodgate out=w30, Error out=w29)
            w31 = w28
          }
          frame True {
            call "Open Gate.gvi"(Floodgate in=w22, Error in=w27) -> (Floodgate out=w30, Error out=w29)
            w31 = w28
          }
        }
        call "Get Discharge.gvi"(Floodgate in=w30, Error in=w29) -> (Floodgate out=w32, Discharge (cfs)=w33, Error out=w34)
        append w32 to w23
        append w31 to w3
        append w26 to w24
        append w33 to w25
      }
      Add Array Elements(numeric array=w13) -> (sum=w35)
      Add Array Elements(numeric array=w25) -> (sum=w36)
      # w37: New discharge
      Add(w35, w36) -> w37
      Merge Errors(w18, w34) -> (error out=w38)
      Add Array Elements(numeric array=w12) -> (sum=w39)
      Add Array Elements(numeric array=w24) -> (sum=w40)
      # w41: Old discharge
      Add(w39, w40) -> w41
      call "Remove Discharge.gvi"(Lake in=w5, Remove Discharge Rate (cfs)=w41, Error in=w38) -> (Lake out=w42, Error out=w43)
      call "Add Discharge.gvi"(Lake in=w42, Add Discharge Rate (cfs)=w37, Error in=w43) -> (Lake out=w44, Error out=w45)
      Property Node(instance in=w9, "Lake"=w44, "Large floodgates"=w11, "Small floodgates"=w23, error in=w45) -> (error out=w1, instance out=w2)
    }
    frame Error {
      w1 = $"Error in"
      w2 = $"Dam in"
      w3 = default
      w4 = default
    }
  }
  $"Large Floodgates Status Out" <- w4
  $"Dam out" <- w2
  $"Error out" <- w1
  $"Small Floodgates Status Out" <- w3
