vi "Set Lake Inflow.gvi"   [LabVIEW NXG 3.0.0]
# Use this VI to edit the Lake’s inflow rate.
inputs:
  "Intake Rate (cfs)": f64, required
  "Dam in": "Dam.gtype", required
  "Error in": error
outputs:
  "Intake Rate out (cfs)": f64
  "Dam out": "Dam.gtype"
  "Error out": error
uses:
  Lake.gtype::Write Intake.gvi
  Lake.gtype::Read Intake Rate.gvi
diagram:
  # #BUG Using an In Place Element Structure,
  # instead of Cluster Properties nodes results
  # in an Internal Error with the Turbine .gtype
  case ($"Error in") {
    frame No Error {
      disable {
        frame Disabled {
          in-place (after $"Dam in") {
            Unbundle Bundle Read Poser() -> ("Lake"=w4)
            call "Write Intake.gvi"(Lake in=w4, Intake Rate (cfs)=$"Intake Rate (cfs)", Error in=$"Error in") -> (Lake out=w5, Error out=w1)
            Unbundle Bundle Write Poser("Lake"=w5)
            w2 = _
          }
        }
        frame Enabled {
          Property Node(instance in=$"Dam in", error in=$"Error in") -> ("Lake"=w6, error out=w7, instance out=w8)
          call "Write Intake.gvi"(Lake in=w6, Intake Rate (cfs)=$"Intake Rate (cfs)", Error in=w7) -> (Lake out=w9, Error out=w10)
          call "Read Intake Rate.gvi"(Lake in=w9, Error in=w10) -> (Lake out=w11, Intake Rate (cfs)=w3, Error out=w12)
          Property Node(instance in=w8, "Lake"=w11, error in=w12) -> (error out=w1, instance out=w2)
        }
      }
    }
    frame Error {
      w1 = $"Error in"
      w2 = $"Dam in"
      w3 = default
    }
  }
  $"Intake Rate out (cfs)" <- w3
  $"Dam out" <- w2
  $"Error out" <- w1
