vi "Set Turbines Status.gvi"   [LabVIEW NXG 3.0.0]
# Use this VI to update the status of the dam’s turbines.
inputs:
  "Turbines Status": bool[] = [FALSE, TRUE, FALSE, FALSE], required
  "Dam in": "Dam.gtype", required
  "Error in": error
  "Turbine Gates": f64[], required
outputs:
  "Turbine Gates Out": f64[]
  "Dam out": "Dam.gtype"
  "Error out": error
  "Turbines Status Out": bool[]
uses:
  Turbine.gtype::Read Generated Power.gvi
  Turbine.gtype::Close Gate.gvi
  Turbine.gtype::Open Gate.gvi
  Lake.gtype::Remove Discharge.gvi
  Lake.gtype::Add Discharge.gvi
diagram:
  case ($"Error in") {
    frame No Error {
      Property Node(instance in=$"Dam in", error in=$"Error in") -> ("Lake"=w5, "Turbines"=w6, error out=w7, instance out=w8)
      s1 = w7  # shift register
      for (iteration -> i1) {
        w9 = each element of w6
        Array Index(array=$"Turbines Status") -> (out0[i1]=w13)
        Array Index(array=$"Turbine Gates") -> (out0[i1]=w14)
        call "Read Generated Power.gvi"(Turbine in=w9, Error in=s1) -> (Turbine out=w15, Error out=w16, Flow (cfs)=w17)
        case (w13) {
          frame False, Default {
            call "Close Gate.gvi"(Turbine in=w15, Open Percentage (-1 keeps previous value)=w14, Error in=w16) -> (Turbine out=w19, Open Percentage out=w20, Error out=w18)
            w21 = w13
          }
          frame True {
            call "Open Gate.gvi"(Turbine in=w15, Open Percentage (-1 keeps previous value)=w14, Error in=w16) -> (Turbine out=w19, Open Percentage out=w20, Error out=w18)
            w21 = w13
          }
        }
        call "Read Generated Power.gvi"(Turbine in=w19, Error in=w18) -> (Turbine out=w22, Error out=w23, Flow (cfs)=w24)
        append w22 to w10
        append w20 to w3
        append w21 to w4
        append w24 to w11
        append w17 to w12
        next s1 = w23
      }
      # w25: New flow
      Add Array Elements(numeric array=w11) -> (sum=w25)
      # w26: Previous flow
      Add Array Elements(numeric array=w12) -> (sum=w26)
      call "Remove Discharge.gvi"(Lake in=w5, Remove Discharge Rate (cfs)=w26, Error in=s1) -> (Lake out=w27, Error out=w28)
      call "Add Discharge.gvi"(Lake in=w27, Add Discharge Rate (cfs)=w25, Error in=w28) -> (Lake out=w29, Error out=w30)
      Property Node(instance in=w8, "Lake"=w29, "Turbines"=w10, error in=w30) -> (error out=w1, instance out=w2)
    }
    frame Error {
      w1 = $"Error in"
      w2 = $"Dam in"
      w3 = default
      w4 = default
    }
  }
  $"Turbines Status Out" <- w4
  $"Turbine Gates Out" <- w3
  $"Dam out" <- w2
  $"Error out" <- w1
