vi "Update Dam.gvi"   [LabVIEW NXG 3.0.0]
# This VI updates the dam’s statee.
# Call this VI once a second.
inputs:
  "Dam in": "Dam.gtype", required
  "Error in": error
outputs:
  "Fill (Acre-feet)": f64
  "Dam out": "Dam.gtype"
  "Error out": error
  "Power Generated (MW)": f64
uses:
  Turbine.gtype::Read Generated Power.gvi
  Lake.gtype::Update Level.gvi
  Lake.gtype::Read Lake Level.gvi
diagram:
  case ($"Error in") {
    frame No Error {
      Property Node(instance in=$"Dam in", error in=$"Error in") -> ("Lake"=w5, "Turbines"=w6, error out=w7, instance out=w8)
      s1 = w7  # shift register
      for {
        w9 = each element of w6
        call "Read Generated Power.gvi"(Turbine in=w9, Error in=s1) -> (Turbine out=w12, Power Generated (MW)=w13, Error out=w14)
        append w12 to w10
        append w13 to w11
        next s1 = w14
      }
      call "Update Level.gvi"(Lake in=w5, Error in=w7) -> (Lake out=w15, Error out=w16)
      call "Read Lake Level.gvi"(Lake in=w15, Error in=w16) -> (Lake out=w17, Fill (Acre-feet)=w3, Error out=w18)
      Merge Errors(w18, s1) -> (error out=w19)
      Property Node(instance in=w8, "Lake"=w17, "Turbines"=w10, error in=w19) -> (error out=w1, instance out=w2)
      Add Array Elements(numeric array=w11) -> (sum=w4)
    }
    frame Error {
      w1 = $"Error in"
      w2 = $"Dam in"
      w3 = default
      w4 = default
    }
  }
  $"Fill (Acre-feet)" <- w3
  $"Dam out" <- w2
  $"Error out" <- w1
  $"Power Generated (MW)" <- w4
