vi "Write Config File.gvi"   [LabVIEW NXG 3.0.0]
# Use this VI to log the status of the dam to its config file
inputs:
  "Report Data": "Report Data.gtype" = {"Lake properties"={"Lake Fill (Acre-feet)"=0, "Lake Intake Rate (cfs)"=0, "Lake Discharge Rate (cfs)"=0}, "Large Floodgates properties"={"# of Large Floodgates"=4, "Large Flodgates Size (cfs)"=0, "Large Floodgates Status"=[]}, "Small Floodgates properties"={"# of Small Floodgates"=5, "Small Floodgates Size (cfs)"=0, "Small Floodgates Status"=[]}, "Turbines properties"={"# of Turbines"=2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}}, required
  "Dam in": "Dam.gtype", required
  "Error in": error
outputs:
  "Dam out": "Dam.gtype"
  "Error out": error
types:
  "Lake properties.gtype" = cluster{"Lake Fill (Acre-feet)": f64, "Lake Intake Rate (cfs)": f64, "Lake Discharge Rate (cfs)": f64}
  "Large Floodgates properties.gtype" = cluster{"# of Large Floodgates": i32, "Large Flodgates Size (cfs)": f64, "Large Floodgates Status": bool[]}
  "Small Floodgates properties.gtype" = cluster{"# of Small Floodgates": i32, "Small Floodgates Size (cfs)": f64, "Small Floodgates Status": bool[]}
  "Turbines properties.gtype" = cluster{"# of Turbines": i32, "Power at Max Flow (MW)": f64, "Turbine Gates Status": bool[], "Turbines State (%)": f64[], "Total Power Being Generated (MW)": f64, "Max Flow (cfs)": f64}
  "Report Data.gtype" = cluster{"Lake properties": "Lake properties.gtype", "Large Floodgates properties": "Large Floodgates properties.gtype", "Small Floodgates properties": "Small Floodgates properties.gtype", "Turbines properties": "Turbines properties.gtype"}
diagram:
  case ($"Error in") {
    frame No Error {
      Property Node(instance in=$"Dam in", error in=$"Error in") -> ("Backup"=w3, error out=w4, instance out=w5)
      Property Node(instance in=w3) -> ("File Path"=w6, "refnum"=w7, instance out=w8)
      Close File(error in=w4, refnum=w7) -> (error out=w9)
      Open Or Create Or Replace File(error in=w9, file path (use dialog)=w6, operation (0:open)="replace or create") -> (error out=w10, refnum out=w11)
      Flatten To JSON(anything=$"Report Data", error in (no error)=w10) -> (JSON string=w12, error out=w13)
      Write To Text File(error in=w13, file (use dialog)=w11, text=w12) -> (error out=w14, refnum out=w15)
      Property Node(instance in=w8, "refnum"=w15) -> (instance out=w16)
      Property Node(instance in=w5, "Backup"=w16, error in=w14) -> (error out=w1, instance out=w2)
    }
    frame Error {
      w1 = $"Error in"
      w2 = $"Dam in"
    }
  }
  $"Dam out" <- w2
  $"Error out" <- w1
