vi "Get Discharge.gvi"   [LabVIEW NXG 3.0.0]
# This method gets the discharge flow of the gate. If the gate is closed, it will return zero.
# This method executes regardless of any incoming error.
inputs:
  "Floodgate in": "Floodgate.gtype", required
  "Error in": error
outputs:
  "Discharge (cfs)": f64
  "Floodgate out": "Floodgate.gtype"
  "Error out": error
  "Open?": bool
  "Size (cfs)": f64
diagram:
  Property Node(instance in=$"Floodgate in") -> ("Size (cfs)"=w1, "State (FALSE = Closed)"=w2, instance out=w3)
  $"Floodgate out" <- w3
  $"Size (cfs)" <- w1
  Select(s=w2, t=w1, f=0) -> w4
  $"Discharge (cfs)" <- w4
  $"Open?" <- w2
  $"Error out" <- $"Error in"
