vi "Init.gvi"   [LabVIEW NXG 3.0.0]
# This method initializes a floodgate and sets its size.
inputs:
  "Size (cfs)": f64, required
  "State (FALSE = Closed)": bool
  "Error in": error
outputs:
  "Floodgate out": "Floodgate.gtype"
  "Error out": error
diagram:
  case ($"Error in") {
    frame No Error {
      In Range And Coerce(lower limit=0, upper limit=f64 default, x=$"Size (cfs)") -> (coerced(x)=w3)
      Property Node(instance in="Floodgate.gtype" constant, "Size (cfs)"=w3, "State (FALSE = Closed)"=$"State (FALSE = Closed)", error in=$"Error in") -> (error out=w1, instance out=w2)
    }
    frame Error {
      w1 = $"Error in"
      w2 = "Floodgate.gtype" constant
    }
  }
  $"Floodgate out" <- w2
  $"Error out" <- w1
