vi "Unit Test.gvi"   [LabVIEW NXG 3.0.0]
# Use this VI to test the functionality of the class
inputs:
  "Size (cfs)": f64 = 1000
outputs:
  "Pass?": bool
uses:
  Floodgate.gtype::Init.gvi
  Floodgate.gtype::Open Gate.gvi
  Floodgate.gtype::Get Discharge.gvi
  Floodgate.gtype::Close Gate.gvi
  Floodgate.gtype::Close.gvi
diagram:
  call "Init.gvi"(Size (cfs)=$"Size (cfs)", State (FALSE = Closed)=FALSE) -> (Floodgate out=w1, Error out=w2)
  call "Open Gate.gvi"(Floodgate in=w1, Error in=w2) -> (Floodgate out=w3, Error out=w4)
  call "Get Discharge.gvi"(Floodgate in=w3, Error in=w4) -> (Floodgate out=w5, Discharge (cfs)=w6, Open?=w7, Error out=w8)
  Is Equal(x=w6, y=$"Size (cfs)") -> w9
  Logical And(w7, w9) -> w10
  call "Close Gate.gvi"(Floodgate in=w5, Error in=w8) -> (Floodgate out=w11, Error out=w12)
  call "Get Discharge.gvi"(Floodgate in=w11, Error in=w12) -> (Floodgate out=w13, Discharge (cfs)=w14, Open?=w15, Error out=w16)
  Is Equal To 0(x=w14) -> w17
  Not(x=w15) -> w18
  Logical And(w17, w18) -> w19
  call "Close.gvi"(Floodgate in=w13, Error in=w16) -> (Error out=w20)
  Not(x=w20) -> w21
  Logical And(w19, w10, w21) -> w22
  $"Pass?" <- w22
