vi "Add Discharge.gvi"   [LabVIEW NXG 3.0.0]
# Use this VI to add a value to the discharge rate of the lake. This VI will add the requested value to the existing discharge rate, it will not replace it.
# This VI will execute regardless of an incoming error.
inputs:
  "Add Discharge Rate (cfs)": f64, required
  "Lake in": "Lake.gtype", required
  "Error in": error
outputs:
  "Lake out": "Lake.gtype"
  "Error out": error
diagram:
  in-place (after $"Lake in") {
    Unbundle Bundle Read Poser() -> ("Discharge Rate (cfs)"=w2)
    Add(w2, $"Add Discharge Rate (cfs)") -> w3
    Unbundle Bundle Write Poser("Discharge Rate (cfs)"=w3)
    w1 = _
  }
  $"Lake out" <- w1
  $"Error out" <- $"Error in"
