vi "Init.gvi"   [LabVIEW NXG 3.0.0]
# Use this VI to create a Lake for your dam
inputs:
  "Size (Acre-feet)": f64
  "Fill (Acre-feet)": f64, required
  "Error in": error
  "Intake Rate (cfs)": f64
  "Discharge Rate (cfs)": f64
outputs:
  "Lake out": "Lake.gtype"
  "Error out": error
uses:
  Lake.gtype::Acres to Feet.gvi
diagram:
  case ($"Error in") {
    frame No Error {
      In Range And Coerce(lower limit=0, upper limit=150000, x=$"Intake Rate (cfs)") -> (coerced(x)=w3)
      In Range And Coerce(lower limit=0, upper limit=f64 default, x=$"Discharge Rate (cfs)") -> (coerced(x)=w4)
      In Range And Coerce(lower limit=0, upper limit=f64 default, x=$"Size (Acre-feet)") -> (coerced(x)=w5)
      call "Acres to Feet.gvi"(Acre-feet=w5) -> (Cubic feet=w6)
      In Range And Coerce(lower limit=0, upper limit=f64 default, x=$"Fill (Acre-feet)") -> (coerced(x)=w7)
      call "Acres to Feet.gvi"(Acre-feet=w7) -> (Cubic feet=w8)
      Property Node(instance in="Lake.gtype" constant, "Size (Cubic feet)"=w6, "Fill (Cubic feet)"=w8, "Intake Rate (cfs)"=w3, "Discharge Rate (cfs)"=w4, error in=$"Error in") -> (error out=w1, instance out=w2)
    }
    frame Error {
      w1 = $"Error in"
      w2 = "Lake.gtype" constant
    }
  }
  $"Lake out" <- w2
  $"Error out" <- w1
