vi "Read Lake Level.gvi"   [LabVIEW NXG 3.0.0]
# Use this VI to read the lake’s water level. This VI executes regardless of an incoming error.
inputs:
  "Lake in": "Lake.gtype", required
  "Error in": error
outputs:
  "Fill (Cubic feet)": f64
  "Lake out": "Lake.gtype"
  "Error out": error
  "Fill (Acre-feet)": f64
  "Overflow?": bool
  "Discharge Rate (cfs)": f64
  "Intake Rate (cfs)": f64
diagram:
  Property Node(instance in=$"Lake in") -> ("Fill (Cubic feet)"=w1, "Size (Cubic feet)"=w2, "Discharge Rate (cfs)"=w3, "Intake Rate (cfs)"=w4, instance out=w5)
  $"Lake out" <- w5
  $"Fill (Cubic feet)" <- w1
  call "Feet to Acres.gvi"(Cubic feet=w1) -> (Acre-feet=w6)
  $"Fill (Acre-feet)" <- w6
  Is Greater(x=w1, y=w2) -> w7
  $"Overflow?" <- w7
  $"Discharge Rate (cfs)" <- w3
  $"Intake Rate (cfs)" <- w4
  $"Error out" <- $"Error in"
