vi "Remove Discharge.gvi"   [LabVIEW NXG 3.0.0]
# Use this VI to remove a value to the discharge rate of the lake. This VI will subtract the requested value to the existing discharge rate, it will not replace it.
inputs:
  "Remove Discharge Rate (cfs)": f64, required
  "Lake in": "Lake.gtype", required
  "Error in": error
outputs:
  "Lake out": "Lake.gtype"
  "Error out": error
diagram:
  case ($"Error in") {
    frame No Error {
      in-place (after $"Lake in") {
        Unbundle Bundle Read Poser() -> ("Discharge Rate (cfs)"=w3)
        Subtract(x=w3, y=$"Remove Discharge Rate (cfs)") -> w4
        Unbundle Bundle Write Poser("Discharge Rate (cfs)"=w4)
        w2 = _
      }
      w1 = $"Error in"
    }
    frame Error {
      w1 = $"Error in"
      w2 = $"Lake in"
    }
  }
  $"Lake out" <- w2
  $"Error out" <- w1
