vi "Unit Test.gvi"   [LabVIEW NXG 3.0.0]
# Use this VI to test the functionality of the lake.
panel controls:
  "Intake Rate (cfs)": f64 = 1
  "Add Discharge Rate (cfs)": f64 = 2
  "Fill (Acre-feet)": f64 = 2
panel indicators:
  "Pass?": bool
uses:
  Lake.gtype::Init.gvi
  Lake.gtype::Update Level.gvi
  Lake.gtype::Read Lake Level.gvi
  Lake.gtype::Write Intake.gvi
  Lake.gtype::Add Discharge.gvi
  Lake.gtype::Close.gvi
diagram:
  call "Init.gvi"(Size (Acre-feet)=5, Fill (Acre-feet)=$"Fill (Acre-feet)", Intake Rate (cfs)=0, Discharge Rate (cfs)=0) -> (Lake out=w1, Error out=w2)
  call "Update Level.gvi"(Lake in=w1, Error in=w2) -> (Lake out=w3, Error out=w4)
  call "Read Lake Level.gvi"(Lake in=w3, Error in=w4) -> (Lake out=w5, Fill (Cubic feet)=w6, Error out=w7)
  call "Acres to Feet.gvi"(Acre-feet=$"Fill (Acre-feet)") -> (Cubic feet=w8)
  Is Equal(x=w8, y=w6) -> w9
  Add(w8, $"Intake Rate (cfs)") -> w10
  call "Write Intake.gvi"(Lake in=w5, Intake Rate (cfs)=$"Intake Rate (cfs)", Error in=w7) -> (Lake out=w11, Error out=w12)
  call "Update Level.gvi"(Lake in=w11, Error in=w12) -> (Lake out=w13, Error out=w14)
  call "Read Lake Level.gvi"(Lake in=w13, Error in=w14) -> (Lake out=w15, Fill (Cubic feet)=w16, Error out=w17)
  Is Equal(x=w10, y=w16) -> w18
  Add(w10, $"Intake Rate (cfs)") -> w19
  Subtract(x=w19, y=$"Add Discharge Rate (cfs)") -> w20
  call "Add Discharge.gvi"(Lake in=w15, Add Discharge Rate (cfs)=$"Add Discharge Rate (cfs)", Error in=w17) -> (Lake out=w21, Error out=w22)
  call "Update Level.gvi"(Lake in=w21, Error in=w22) -> (Lake out=w23, Error out=w24)
  call "Read Lake Level.gvi"(Lake in=w23, Error in=w24) -> (Lake out=w25, Fill (Cubic feet)=w26, Error out=w27)
  Is Equal(x=w20, y=w26) -> w28
  call "Close.gvi"(Lake in=w25, Error in=w27) -> (Error out=w29)
  Not(x=w29) -> w30
  Logical And(w9, w18, w28, w30) -> w31
  $"Pass?" <- w31
