vi "Update Level.gvi"   [LabVIEW NXG 3.0.0]
# Use this VI to update the level of the lake. This VI will take the current Fill and will add the Intake.
# Run this VI in a one-second cycle.
# This VI will execute regardless of an incoming error.
inputs:
  "Lake in": "Lake.gtype", required
  "Error in": error
outputs:
  "Lake out": "Lake.gtype"
  "Error out": error
diagram:
  Property Node(instance in=$"Lake in") -> ("Intake Rate (cfs)"=w1, "Discharge Rate (cfs)"=w2, error out=w3, instance out=w4)
  Merge Errors($"Error in", w3) -> (error out=w5)
  $"Error out" <- w5
  in-place (after w4) {
    Unbundle Bundle Read Poser() -> ("Fill (Cubic feet)"=w7)
    Add(w7, w1) -> w8
    Subtract(x=w8, y=w2) -> w9
    In Range And Coerce(lower limit=0, upper limit=f64 default, x=w9) -> (coerced(x)=w10)
    Unbundle Bundle Write Poser("Fill (Cubic feet)"=w10)
    w6 = _
  }
  $"Lake out" <- w6
