vi "Write Intake.gvi"   [LabVIEW NXG 3.0.0]
# Use this method to write a new intake rate for the lake
inputs:
  "Intake Rate (cfs)": f64, required
  "Lake in": "Lake.gtype", required
  "Error in": error
outputs:
  "Lake out": "Lake.gtype"
  "Error out": error
diagram:
  case ($"Error in") {
    frame No Error {
      In Range And Coerce(lower limit=0, upper limit=150000, x=$"Intake Rate (cfs)") -> (coerced(x)=w3)
      Property Node(instance in=$"Lake in", "Intake Rate (cfs)"=w3, error in=$"Error in") -> (error out=w1, instance out=w2)
    }
    frame Error {
      w1 = $"Error in"
      w2 = $"Lake in"
    }
  }
  $"Lake out" <- w2
  $"Error out" <- w1
