vi "Close.gvi"   [LabVIEW NXG 3.0.0]
# This VI closes a reference to a log file.
# This VI executes regardless of an incoming error.
inputs:
  "Report in": "Report.gtype", required
  "Error in": error
outputs:
  "Log Path": path
  "Error out": error
diagram:
  Property Node(instance in=$"Report in") -> ("Report Refnum"=w1, "Log Path"=w2, error out=w3)
  Close File(error in=w3, refnum=w1) -> (error out=w4)
  Merge Errors($"Error in", w4) -> (error out=w5)
  $"Error out" <- w5
  $"Log Path" <- w2
