vi "Open or Create.gvi"   [LabVIEW NXG 3.0.0]
# This VI takes in a report path and opens a reference to it. If it is not already created, it will create it and set the default data.
# If the report’s path it will default to <Public Documents>/Dam_Log.csv
inputs:
  "Log Path In": path
  "Error in": error
outputs:
  "Log Path Out": path
  "Report out": "Report.gtype"
  "Error out": error
uses:
  NI::G Core::File IO (General)::Get System Directory.gvi
diagram:
  case ($"Error in") {
    frame No Error {
      Is Empty String Or Path(string/path=$"Log Path In") -> w4
      Is Not A Number Or Path Or Refnum(number=$"Log Path In") -> w5
      Logical Or(w4, w5) -> w6
      case (w6) {
        frame False, Default {
          w3 = $"Log Path In"
        }
        frame True {
          call "Get System Directory.gvi"(type="Public Documents", create directory if not found?=FALSE) -> (system directory=w7)
          Build Path(base path=w7, name or relative path="Dam_Log.csv") -> (appended path=w3)
        }
      }
      Open Or Create Or Replace File(error in=$"Error in", file path (use dialog)=w3, operation (0:open)="open or create") -> (error out=w8, refnum out=w9)
      Get File Size(error in=w8, file=w9) -> (error out=w10, refnum out=w11, size (in bytes)=w12)
      Set File Position(error in=w10, offset (in bytes) (0)=w12, refnum=w11) -> (error out=w13, refnum out=w14)
      Property Node(instance in="Report.gtype" constant, "Log Path"=w3, "Report Refnum"=w14, error in=w13) -> (error out=w1, instance out=w2)
    }
    frame Error {
      w1 = $"Error in"
      w2 = "Report.gtype" constant
      w3 = default
    }
  }
  $"Log Path Out" <- w3
  $"Report out" <- w2
  $"Error out" <- w1
