vi "Read All.gvi"   [LabVIEW NXG 3.0.0]
# Read the entire log.
inputs:
  "Report in": "Report.gtype", required
  "Error in": error
outputs:
  "All Data": string
  "Report out": "Report.gtype"
  "Error out": error
diagram:
  case ($"Error in") {
    frame No Error {
      Property Node(instance in=$"Report in", error in=$"Error in") -> ("Report Refnum"=w4, error out=w5, instance out=w6)
      Get File Position(error in=w5, refnum=w4) -> (error out=w7, offset (in bytes) (0)=w8, refnum out=w9)
      Set File Position(error in=w7, offset (in bytes) (0)=0, refnum=w9) -> (error out=w10, refnum out=w11)
      Read From Text File(error in=w10, file (use dialog)=w11) -> (error out=w12, refnum out=w13, text=w3)
      Set File Position(error in=w12, offset (in bytes) (0)=w8, refnum=w13) -> (error out=w14, refnum out=w15)
      Property Node(instance in=w6, "Report Refnum"=w15, error in=w14) -> (error out=w1, instance out=w2)
    }
    frame Error {
      w1 = $"Error in"
      w2 = $"Report in"
      w3 = default
    }
  }
  $"All Data" <- w3
  $"Report out" <- w2
  $"Error out" <- w1
