vi "Text Array to Tabbed String.gvi"   [LabVIEW NXG 3.0.0]
# This VI converst an array of strings to a tab’separated single string that you can log into a CSV file
inputs:
  "Text Array": string[], required
outputs:
  "Text to Write": string
diagram:
  s1 = ""  # shift register
  for (iteration -> i1) {
    w1 = each element of $"Text Array"
    Is Not Equal To 0(x=i1) -> w2
    Select(s=w2, t=",", f="") -> w3
    Concatenate Strings(s1, w3, w1) -> w4
    next s1 = w4
  }
  $"Text to Write" <- s1
