vi "Unit Test.gvi"   [LabVIEW NXG 3.0.0]
panel indicators:
  "All Data": string
  "Pass?": bool
types:
  "Lake properties.gtype" = cluster{"Lake Fill (Acre-feet)": f64, "Lake Intake Rate (cfs)": f64, "Lake Discharge Rate (cfs)": f64}
  "Large Floodgates properties.gtype" = cluster{"# of Large Floodgates": i32, "Large Flodgates Size (cfs)": f64, "Large Floodgates Status": bool[]}
  "Small Floodgates properties.gtype" = cluster{"# of Small Floodgates": i32, "Small Floodgates Size (cfs)": f64, "Small Floodgates Status": bool[]}
  "Turbines properties.gtype" = cluster{"# of Turbines": i32, "Power at Max Flow (MW)": f64, "Turbine Gates Status": bool[], "Turbines State (%)": f64[], "Total Power Being Generated (MW)": f64, "Max Flow (cfs)": f64}
  "Report Data.gtype" = cluster{"Lake properties": "Lake properties.gtype", "Large Floodgates properties": "Large Floodgates properties.gtype", "Small Floodgates properties": "Small Floodgates properties.gtype", "Turbines properties": "Turbines properties.gtype"}
uses:
  NI::G Core::File IO (General)::Get System Directory.gvi
  Report.gtype::Open or Create.gvi
  Report.gtype::Write Status.gvi
  Report.gtype::Read All.gvi
  Report.gtype::Close.gvi
diagram:
  w1 = "Report Data.gtype" {"Lake properties"={"Lake Fill (Acre-feet)"=1, "Lake Intake Rate (cfs)"=1, "Lake Discharge Rate (cfs)"=1}, "Large Floodgates properties"={"# of Large Floodgates"=4, "Large Flodgates Size (cfs)"=1, "Large Floodgates Status"=[TRUE]}, "Small Floodgates properties"={"# of Small Floodgates"=5, "Small Floodgates Size (cfs)"=1, "Small Floodgates Status"=[TRUE]}, "Turbines properties"={"# of Turbines"=2, "Power at Max Flow (MW)"=1, "Turbine Gates Status"=[TRUE], "Turbines State (%)"=[100], "Total Power Being Generated (MW)"=1, "Max Flow (cfs)"=1}}
  call "Get System Directory.gvi"(type="User Temporary") -> (system directory=w2)
  Build Path(base path=w2, name or relative path="File_Unit_Test.csv") -> (appended path=w3)
  call "Open or Create.gvi"(Log Path In=w3) -> (Report out=w4, Error out=w5)
  call "Write Status.gvi"(Report in=w4, Report Data=w1, Error in=w5) -> (Report out=w6, Error out=w7)
  call "Read All.gvi"(Report in=w6, Error in=w7) -> (Report out=w8, All Data=w9, Error out=w10)
  $"All Data" <- w9
  call "Close.gvi"(Report in=w8, Error in=w10) -> (Error out=w11)
  Not(x=w11) -> w12
  $"Pass?" <- w12
