vi "Write Line to File.gvi"   [LabVIEW NXG 3.0.0]
# This VI writes a line to the report-log
inputs:
  "Report in": "Report.gtype", required
  "Text to Write": string, required
  "Error Out": error
outputs:
  "Report Out": "Report.gtype"
  "Error In": error
diagram:
  case ($"Error Out") {
    frame Error, Default {
      w1 = $"Report in"
      w2 = $"Error Out"
    }
    frame No Error {
      Property Node(instance in=$"Report in", error in=$"Error Out") -> ("Report Refnum"=w3, error out=w4, instance out=w5)
      Concatenate Strings($"Text to Write", "\r\n") -> w6
      Write To Text File(error in=w4, file (use dialog)=w3, text=w6) -> (error out=w7, refnum out=w8)
      Property Node(instance in=w5, "Report Refnum"=w8, error in=w7) -> (error out=w2, instance out=w1)
    }
  }
  $"Report Out" <- w1
  $"Error In" <- w2
