vi "Write Status.gvi"   [LabVIEW NXG 3.0.0]
# Writes a new entry to the log with the current dam’s status.
inputs:
  "Report Data": "Report Data.gtype" = {"Lake properties"={"Lake Fill (Acre-feet)"=0, "Lake Intake Rate (cfs)"=0, "Lake Discharge Rate (cfs)"=0}, "Large Floodgates properties"={"# of Large Floodgates"=4, "Large Flodgates Size (cfs)"=0, "Large Floodgates Status"=[]}, "Small Floodgates properties"={"# of Small Floodgates"=5, "Small Floodgates Size (cfs)"=0, "Small Floodgates Status"=[]}, "Turbines properties"={"# of Turbines"=2, "Power at Max Flow (MW)"=0, "Turbine Gates Status"=[], "Turbines State (%)"=[], "Total Power Being Generated (MW)"=0}}, required
  "Report in": "Report.gtype", required
  "Error in": error
outputs:
  "Report out": "Report.gtype"
  "Error out": error
panel indicators:
  "Log Entry": string[]
types:
  "Lake properties.gtype" = cluster{"Lake Fill (Acre-feet)": f64, "Lake Intake Rate (cfs)": f64, "Lake Discharge Rate (cfs)": f64}
  "Large Floodgates properties.gtype" = cluster{"# of Large Floodgates": i32, "Large Flodgates Size (cfs)": f64, "Large Floodgates Status": bool[]}
  "Small Floodgates properties.gtype" = cluster{"# of Small Floodgates": i32, "Small Floodgates Size (cfs)": f64, "Small Floodgates Status": bool[]}
  "Turbines properties.gtype" = cluster{"# of Turbines": i32, "Power at Max Flow (MW)": f64, "Turbine Gates Status": bool[], "Turbines State (%)": f64[], "Total Power Being Generated (MW)": f64}
  "Report Data.gtype" = cluster{"Lake properties": "Lake properties.gtype", "Large Floodgates properties": "Large Floodgates properties.gtype", "Small Floodgates properties": "Small Floodgates properties.gtype", "Turbines properties": "Turbines properties.gtype"}
uses:
  Report.gtype::Read All.gvi
  NI::G Core::Strings::Trim Whitespace.gvi
diagram:
  case ($"Error in") {
    frame No Error {
      Property Node(instance in=$"Report Data") -> ("Lake properties"=w4, "Large Floodgates properties"=w5, "Small Floodgates properties"=w6, "Turbines properties"=w7)
      Property Node(instance in=w7) -> ("Turbine Gates Status"=w8, "Turbines State (%)"=w9, "Total Power Being Generated (MW)"=w10)
      Number To Fractional String(number=w10) -> (F-format string=w11)
      for (iteration -> i1) {
        w12 = each element of w8
        w13 = each element of w9
        Select(s=w12, t="OPEN", f="CLOSED") -> w16
        Number To Fractional String(number=w13) -> (F-format string=w17)
        Build Array(w16, w17) -> w18
        Increment(x=i1) -> w19
        Number To Decimal String(number=w19) -> (decimal integer string=w20)
        Concatenate Strings("Turbine ", w20, " Gate") -> w21
        Concatenate Strings("Turbine ", w20, " % Open") -> w22
        Build Array(w21, w22) -> w23
        concatenate w18 onto w14
        concatenate w23 onto w15
      }
      Property Node(instance in=w6) -> ("Small Floodgates Status"=w24)
      Property Node(instance in=w5) -> ("Large Floodgates Status"=w25)
      Build Array(w25, w24) -> w26
      Array Size(array=w25) -> (size(s)=w27)
      for (iteration -> i2) {
        w28 = each element of w26
        Select(s=w28, t="OPEN", f="CLOSED") -> w31
        Is Less(x=i2, y=w27) -> w32
        Select(s=w32, t="Large ", f="Small ") -> w33
        Increment(x=i2) -> w34
        Subtract(x=w34, y=w27) -> w35
        Select(s=w32, t=w34, f=w35) -> w36
        Number To Decimal String(number=w36) -> (decimal integer string=w37)
        Concatenate Strings(w33, "Floodgate Status #", w37) -> w38
        append w31 to w29
        append w38 to w30
      }
      Property Node(instance in=w4) -> ("Lake Fill (Acre-feet)"=w39, "Lake Intake Rate (cfs)"=w40, "Lake Discharge Rate (cfs)"=w41)
      Number To Fractional String(number=w39) -> (F-format string=w42)
      Number To Fractional String(number=w41) -> (F-format string=w43)
      Subtract(x=w40, y=w41) -> w44
      Is Equal To 0(x=w44) -> w45
      Is Greater Than 0(x=w44) -> w46
      Select(s=w46, t="Increasing Trend", f="Decreasing Trend") -> w47
      Select(s=w45, t="Flat Trend", f=w47) -> w48
      Format Date Time String(time format string (%c)="%m/%d/%Y %H:%M:%S") -> (date/time string=w49)
      Build Array(w49, w42, w29, w14, w11, w43, w48) -> w3
      call "Text Array to Tabbed String.gvi"(Text Array=w3) -> (Text to Write=w50)
      call "Read All.gvi"(Report in=$"Report in", Error in=$"Error in") -> (Report out=w51, All Data=w52, Error out=w53)
      Build Array("Timestamp", "Lake Fill", w30, w15, "Total Power generated", "Lake Discharge Rate", "Lake Trend") -> w54
      call "Text Array to Tabbed String.gvi"(Text Array=w54) -> (Text to Write=w55)
      call "Trim Whitespace.gvi"(string=w52) -> (trimmed string=w56)
      Is Empty String Or Path(string/path=w56) -> w57
      case (w57) {
        frame False, Default {
          w58 = w51
          w59 = w53
        }
        frame True {
          # Add headers if they do not exist already
          call "Write Line to File.gvi"(Report in=w51, Text to Write=w55, Error Out=w53) -> (Report Out=w58, Error In=w59)
        }
      }
      call "Write Line to File.gvi"(Report in=w58, Text to Write=w50, Error Out=w59) -> (Report Out=w2, Error In=w1)
    }
    frame Error {
      w1 = $"Error in"
      w2 = $"Report in"
      w3 = default
    }
  }
  $"Log Entry" <- w3
  $"Report out" <- w2
  $"Error out" <- w1
