vi "Close Gate.gvi"   [LabVIEW NXG 3.0.0]
# Use this VI to close the gate to the turbine. This method will execute regardless of an incoming error.
inputs:
  "Open Percentage (-1 keeps previous value)": f64 = -1
  "Turbine in": "Turbine.gtype", required
  "Error in": error
outputs:
  "Open Percentage out": f64
  "Turbine out": "Turbine.gtype"
  "Error out": error
diagram:
  Property Node(instance in=$"Turbine in") -> ("Open Percentage (%)"=w1, error out=w2, instance out=w3)
  In Range And Coerce(lower limit=0, upper limit=100, x=$"Open Percentage (-1 keeps previous value)") -> (In Range?=w4, coerced(x)=w5)
  Select(s=w4, t=w5, f=w1) -> w6
  $"Open Percentage out" <- w6
  Property Node(instance in=w3, "Gate State (FALSE = Closed)"=FALSE, "Open Percentage (%)"=w6, error in=w2) -> (error out=w7, instance out=w8)
  $"Turbine out" <- w8
  Merge Errors($"Error in", w7) -> (error out=w9)
  $"Error out" <- w9
