vi "Init.gvi"   [LabVIEW NXG 3.0.0]
# This VI creates an object based on the characteristics of a turbine
inputs:
  "Power at Max Flow (MW)": f64, required
  "Gate State (FALSE = Closed)": bool
  "Error in": error
  "Open Percentage (%)": f64 = 100
  "Max Flow (cfs)": f64, required
outputs:
  "Turbine out": "Turbine.gtype"
  "Error out": error
diagram:
  case ($"Error in") {
    frame No Error {
      In Range And Coerce(lower limit=0, upper limit=100, x=$"Power at Max Flow (MW)") -> (coerced(x)=w3)
      Property Node(instance in="Turbine.gtype" constant, "Gate State (FALSE = Closed)"=$"Gate State (FALSE = Closed)", "Open Percentage (%)"=$"Open Percentage (%)", "Power at Max Flow (MW)"=w3, "Max Flow (cfs)"=$"Max Flow (cfs)", error in=$"Error in") -> (error out=w1, instance out=w2)
    }
    frame Error {
      w1 = $"Error in"
      w2 = "Turbine.gtype" constant
    }
  }
  $"Turbine out" <- w2
  $"Error out" <- w1
