vi "Open Gate.gvi"   [LabVIEW NXG 3.0.0]
# Use this VI to open the gates of a turbine.
# Not wiring an Open Percentage to this method will keep the previous percentage of the turbine
inputs:
  "Open Percentage (-1 keeps previous value)": f64 = -1
  "Turbine in": "Turbine.gtype", required
  "Error in": error
outputs:
  "Open Percentage out": f64
  "Turbine out": "Turbine.gtype"
  "Error out": error
diagram:
  case ($"Error in") {
    frame No Error {
      Property Node(instance in=$"Turbine in", error in=$"Error in") -> ("Open Percentage (%)"=w4, error out=w5, instance out=w6)
      In Range And Coerce(lower limit=0, upper limit=100, x=$"Open Percentage (-1 keeps previous value)") -> (In Range?=w7)
      Select(s=w7, t=$"Open Percentage (-1 keeps previous value)", f=w4) -> w3
      Property Node(instance in=w6, "Gate State (FALSE = Closed)"=TRUE, "Open Percentage (%)"=w3, error in=w5) -> (error out=w1, instance out=w2)
    }
    frame Error {
      w1 = $"Error in"
      w2 = $"Turbine in"
      w3 = default
    }
  }
  $"Open Percentage out" <- w3
  $"Turbine out" <- w2
  $"Error out" <- w1
