vi "Read Generated Power.gvi"   [LabVIEW NXG 3.0.0]
# Use this VI to know how much power is being generated by the turbine.
# This equation assumes linear relation
# between the maximum power generated
# and the percentage of the gate that is open
inputs:
  "Turbine in": "Turbine.gtype", required
  "Error in": error
outputs:
  "Power Generated (MW)": f64
  "Turbine out": "Turbine.gtype"
  "Error out": error
  "Gate State (FALSE = Closed)": bool
  "Open Percentage (%)": f64
  "Power at Max Flow (MW)": f64
  "Flow (cfs)": f64
  "Max Flow (cfs)": f64
diagram:
  case ($"Error in") {
    frame No Error {
      Property Node(instance in=$"Turbine in", error in=$"Error in") -> ("Gate State (FALSE = Closed)"=w4, "Open Percentage (%)"=w5, "Power at Max Flow (MW)"=w6, "Max Flow (cfs)"=w8, error out=w1, instance out=w2)
      case (w4) {
        frame False, Default {
          w3 = 0
          w7 = 0
        }
        frame True {
          # This equation assumes linear relation
          # between the maximum power generated
          # and the percentage of the gate that is open
          Divide(x=w5, y=100) -> w9
          Multiply(w9, w8) -> w7
          Multiply(w9, w6) -> w3
        }
      }
    }
    frame Error {
      w1 = $"Error in"
      w2 = $"Turbine in"
      w3 = default
      w4 = default
      w5 = default
      w6 = default
      w7 = default
      w8 = default
    }
  }
  $"Turbine out" <- w2
  $"Error out" <- w1
  $"Gate State (FALSE = Closed)" <- w4
  $"Flow (cfs)" <- w7
  $"Power Generated (MW)" <- w3
  $"Open Percentage (%)" <- w5
  $"Power at Max Flow (MW)" <- w6
  $"Max Flow (cfs)" <- w8
