vi "Unit Test.gvi"   [LabVIEW NXG 3.0.0]
# Use this VI to test the class functionality.
panel controls:
  "Power at Max Flow (MW)": f64 = 1
  "Max Flow (cfs)": f64 = 100
panel indicators:
  "Pass?": bool
uses:
  Turbine.gtype::Init.gvi
  Turbine.gtype::Open Gate.gvi
  Turbine.gtype::Read Generated Power.gvi
  Turbine.gtype::Close Gate.gvi
  Turbine.gtype::Close.gvi
diagram:
  call "Init.gvi"(Power at Max Flow (MW)=$"Power at Max Flow (MW)", Max Flow (cfs)=$"Max Flow (cfs)") -> (Turbine out=w1, Error out=w2)
  call "Open Gate.gvi"(Turbine in=w1, Open Percentage (-1 keeps previous value)=100, Error in=w2) -> (Turbine out=w3, Error out=w4)
  call "Read Generated Power.gvi"(Turbine in=w3, Error in=w4) -> (Turbine out=w5, Power Generated (MW)=w6, Error out=w7)
  Is Equal(x=$"Power at Max Flow (MW)", y=w6) -> w8
  Divide(x=$"Power at Max Flow (MW)", y=2) -> w9
  Round To Nearest(number=w9) -> w10
  call "Open Gate.gvi"(Turbine in=w5, Open Percentage (-1 keeps previous value)=50, Error in=w7) -> (Turbine out=w11, Error out=w12)
  call "Read Generated Power.gvi"(Turbine in=w11, Error in=w12) -> (Turbine out=w13, Power Generated (MW)=w14, Error out=w15)
  Round To Nearest(number=w14) -> w16
  Is Equal(x=w10, y=w16) -> w17
  call "Close Gate.gvi"(Turbine in=w13, Error in=w15) -> (Turbine out=w18, Error out=w19)
  call "Read Generated Power.gvi"(Turbine in=w18, Error in=w19) -> (Turbine out=w20, Power Generated (MW)=w21, Error out=w22, Flow (cfs)=w23)
  Is Equal To 0(x=w21) -> w24
  Is Equal To 0(x=w23) -> w25
  call "Close.gvi"(Turbine in=w20, Error in=w22) -> (Error out=w26)
  Not(x=w26) -> w27
  Logical And(w8, w17, w25, w24, w27) -> w28
  $"Pass?" <- w28
