vi "Main.gvi"   [LabVIEW NXG 3.0.0]
panel controls:
  "Stop": bool
  "Settings": i32
  "Inflow (cfs)": f64 = 1000
  "Large Floodgates Status": bool[] = [FALSE, FALSE, FALSE, FALSE]
  "Small Floodgates Status": bool[] = [FALSE, FALSE, FALSE, FALSE, FALSE]
  "Turbines Status": bool[] = [FALSE, TRUE, FALSE, FALSE]
  "Turbines Open Gap (%)": f64[] = [41.8597271091, 60.594530904]
  "Reset": bool
  "Load Config File": path
  "Save Config File": bool
  "Close Large Floodgates": bool
  "Open Large Floodgates": bool
  "Close Small Floodgates": bool
  "Open Small Floodgates": bool
  "Open Log File Location": bool
panel indicators:
  "Lake Fill (Acre-feet)": f64
  "Inflow (cfs) reading": f64
  "Total Power Generation (MW)": f64
  "Log Path": path
  "Fill (Acre-feet)": f64
  "Small Floodgate_1": bool
  "Small Floodgate_2": bool
  "Small Floodgate_3": bool
  "Small Floodgate_4": bool
  "Small Floodgate_5": bool
  "Large Floodgate_1": bool
  "Large Floodgate_2": bool
  "Large Floodgate_3": bool
  "Large Floodgate_4": bool
  "Turbine 1": bool
  "Turbine 2": bool
  "Turbine 1 Open": f64
  "Turbine 2 Open": f64
types:
  T1 = cluster{"Element 1": bool[], "Element 2": bool[]}
uses:
  NI::G Core::Error::Build Error Cluster.gvi
  Dam.gtype::Close.gvi
  Dam.gtype::Update Dam.gvi
  Dam.gtype::Get Dams Data.gvi
  Dam.gtype::Log Status.gvi
  NI::G Core::Error::Clear Error Cluster.gvi
  Dam.gtype::Init.gvi
  Dam.gtype::Set Lake Inflow.gvi
  Dam.gtype::Set Turbines Status.gvi
  Dam.gtype::Set Floodgates Status.gvi
  Dam.gtype::Write Config File.gvi
  NI::G Core::Libraries and Executables::System Exec.gvi
  NI::G Core::Error::Multiplex Errors.gvi
  NI::G Core::Error::Display Error.gvi
diagram:
  call "Open QMH.gvi"() -> (Message Queue=w1, Stop Event=w2, error out=w3)
  call "Send Message.gvi"(Queue in=w1, Command="Initialize", Data=FALSE, Input=w3) -> (Queue out=w4, Output=w5)
  Register For Events("Stop Event"=w2, error in=w5) -> (error out=w6, event registration refnum out=w7)
  while {
    event (timeout = 50) (dynamic events = w7) {
      on "Stop" Value changed {
        call "Send Message.gvi"(Queue in=w4, Command="Stop", Data=w6, Input=w6) -> (Output=w9)
        # This case sends a stop to the dam
        # It DOES NOT stop the consumer loop
        w8 = default
      }
      on "Dynamic" Stop Event {
        # This case stops the consumer loop
        # We make sure this can only happen if the producer loop stops too
        Event Data() -> ("event data"=w8)
        w9 = w6
      }
      on Timeout {
        call "Update Dam and Log.gvi"(Message Queue In=w4, Dam Update Time=1, Log Time=60, Error Input=w6) -> (Error Output=w9)
        # This case is used to keep the dam updated
        # Configure here the timing in which we refresh the dam
        # and the timing in which we log.
        w8 = default
      }
      on "Reset" Value changed {
        # This case sends a reset to the dam
        # It sets all values to the default data
        Build Cluster(TRUE, path constant) -> w10
        call "Send Message.gvi"(Queue in=w4, Command="Initialize", Data=w10, Input=w6) -> (Output=w9)
        w8 = default
      }
      on "Inflow (cfs)" Value changed {
        call "Send Message.gvi"(Queue in=w4, Command="Change Inflow", Data=$"Inflow (cfs)", Input=w6) -> (Output=w9)
        # This case sends a new inflow to the dam
        w8 = default
      }
      on "Turbines Open Gap (%)" Value changed; "Turbines Status" Value changed {
        Build Cluster($"Turbines Status", $"Turbines Open Gap (%)") -> w11
        # This case sends a new turbine settings to the dam
        call "Send Message.gvi"(Queue in=w4, Command="ChangeTurbines Status", Data=w11, Input=w6) -> (Output=w9)
        w8 = default
      }
      on "Large Floodgates Status" Value changed; "Small Floodgates Status" Value changed {
        Build Cluster($"Large Floodgates Status", $"Small Floodgates Status") -> w12
        # This case sends new floodgate settings to the dam
        call "Send Message.gvi"(Queue in=w4, Command="Change Floodgates Status", Data=w12, Input=w6) -> (Output=w9)
        w8 = default
      }
      on "Load Config File" Value changed {
        # This case sends a new config file to the dam
        # It sets all values to the default data
        Build Cluster(FALSE, $"Load Config File") -> w13
        call "Send Message.gvi"(Queue in=w4, Command="Initialize", Data=w13, Input=w6) -> (Output=w9)
        w8 = default
      }
      on "Save Config File" Value changed {
        call "Send Message.gvi"(Queue in=w4, Command="Save Config File", Input=w6) -> (Output=w9)
        w8 = default
      }
      on "Close Large Floodgates" Value changed; "Open Large Floodgates" Value changed {
        Property Node(instance in=reference to "Large Floodgates Status", error in=w6) -> ("Value"=w14, error out=w15, instance out=w16)
        Array Size(array=w14) -> (size(s)=w17)
        Initialize Array(element=$"Open Large Floodgates", size=w17) -> w18
        Property Node(instance in=w16, "ValueSignaling"=w18, error in=w15) -> (error out=w9)
        w8 = default
      }
      on "Close Small Floodgates" Value changed; "Open Small Floodgates" Value changed {
        Property Node(instance in=reference to "Small Floodgates Status", error in=w6) -> ("Value"=w19, error out=w20, instance out=w21)
        Array Size(array=w19) -> (size(s)=w22)
        Initialize Array(element=$"Open Small Floodgates", size=w22) -> w23
        Property Node(instance in=w21, "ValueSignaling"=w23, error in=w20) -> (error out=w9)
        w8 = default
      }
      on "Open Log File Location" Value changed {
        Strip Path(path=$"Log Path") -> (stripped path=w24)
        Format Into String(formatString="cmd.exe /c start \"\" \"%s\"", errIn=w6, w24) -> (outString=w25, errOut=w26)
        call "Send Message.gvi"(Queue in=w4, Command="Execute Cmd Line", Data=w25, Input=w26) -> (Output=w9)
        w8 = default
      }
    }
    call "Error Check.gvi"(Message Queue In=w4, Error In=w9) -> (Message Queue Out=w27, Error Output=w28)
    Logical Or(w28, w8) -> w29
    stop if w29
  }
  s1 = "Dam.gtype" constant  # shift register
  while {
    call "Read Message.gvi"(Message Queue In=w4, Error in=w6) -> (Message Queue Out=w30, Command=w31, Data=w32, Error out=w33)
    case (w31) {
      frame Default {
        # This case executes when an undefined command arrives
        Format Into String(initString="Unknown command received: ", errIn=w33, w31) -> (outString=w37, errOut=w38)
        call "Build Error Cluster.gvi"(error in=w38, code=5000, description=w37) -> (error out=w34)
        w35 = default
        w36 = s1
      }
      frame "Stop" {
        Variant To Data(error in (no error)=w33, type=w33, variant=w32) -> (data=w39, error out=w40)
        Generate User Event(error in=w40, event data=TRUE, user event=w2) -> (error out=w41)
        call "Close.gvi"(Dam in=s1, Error in=w41) -> (Error out=w42)
        # This case stops the dam and sends a stop command to the producer loop
        Merge Errors(w39, w42) -> (error out=w34)
        w35 = TRUE
        w36 = "Dam.gtype" constant
      }
      frame "Update Dam" {
        call "Update Dam.gvi"(Dam in=s1, Error in=w33) -> (Dam out=w43, Fill (Acre-feet)=w44, Power Generated (MW)=w45, Error out=w46)
        call "Get Dams Data.gvi"(Dam in=w43, Error in=w46) -> (Dam out=w36, Dam's data=w47, Error out=w34)
        Property Node(instance in=w47) -> ("Large Floodgates properties"=w48, "Small Floodgates properties"=w49, "Turbines properties"=w50)
        Property Node(instance in=w48) -> ("Large Floodgates Status"=w51)
        Array Index(array=w51) -> (out0[_]=w52, out1[_]=w53, out2[_]=w54, out3[_]=w55)
        $"Large Floodgate_1" <- w52
        # This case should be run every second to make sure the dam updates its levels every second.
        $"Fill (Acre-feet)" <- w44
        $"Large Floodgate_2" <- w53
        $"Lake Fill (Acre-feet)" <- w44
        $"Large Floodgate_3" <- w54
        $"Total Power Generation (MW)" <- w45
        $"Large Floodgate_4" <- w55
        Property Node(instance in=w49) -> ("Small Floodgates Status"=w56)
        Array Index(array=w56) -> (out0[_]=w57, out1[_]=w58, out2[_]=w59, out3[_]=w60, out4[_]=w61)
        $"Small Floodgate_1" <- w57
        $"Small Floodgate_2" <- w58
        $"Small Floodgate_3" <- w59
        $"Small Floodgate_4" <- w60
        $"Small Floodgate_5" <- w61
        Property Node(instance in=w50) -> ("Turbine Gates Status"=w62, "Turbines State (%)"=w63)
        Array Index(array=w62) -> (out0[_]=w64, out1[_]=w65)
        $"Turbine 1" <- w64
        $"Turbine 2" <- w65
        Array Index(array=w63) -> (out0[_]=w66, out1[_]=w67)
        $"Turbine 1 Open" <- w66
        $"Turbine 2 Open" <- w67
        w35 = default
      }
      frame "Log" {
        # This case asks the dam to log its state into its report
        call "Log Status.gvi"(Dam in=s1, Error in=w33) -> (Dam out=w36, Error out=w34)
        w35 = default
      }
      frame "Initialize" {
        Clear Data(reference in=reference to "Lake Fill (Acre-feet)") -> (error out=w68)
        call "Clear Error Cluster.gvi"(error in=w68)
        call "Close.gvi"(Dam in=s1, Error in=w33) -> (Error out=w69)
        call "Clear Error Cluster.gvi"(error in=w69) -> (error out=w70)
        w71 = cluster{"Element 1": bool, "Element 2": path} {all zero or empty}
        Variant To Data(type=w71, variant=w32) -> (data=w72, error out=w73)
        Property Node(instance in=w72) -> ("Element 1"=w74, "Element 2"=w75)
        call "Init.gvi"(Status backup=w75, Reset?=w74, Error in=w70) -> (Dam's data=w76, Dam out=w36, Log Path Out=w77, Error out=w34)
        $"Log Path" <- w77
        call "Clear Error Cluster.gvi"(error in=w73)
        Property Node(instance in=w76) -> ("Lake properties"=w78, "Large Floodgates properties"=w79, "Small Floodgates properties"=w80, "Turbines properties"=w81)
        Property Node(instance in=w78) -> ("Lake Intake Rate (cfs)"=w82)
        $"Inflow (cfs) reading" <- w82
        $"Inflow (cfs)" <- w82
        # This case initializes a new dam.
        # You can use it to reset it to its default values, too
        Property Node(instance in=w79) -> ("Large Floodgates Status"=w83)
        $"Large Floodgates Status" <- w83
        Property Node(instance in=w80) -> ("Small Floodgates Status"=w84)
        $"Small Floodgates Status" <- w84
        Property Node(instance in=w81) -> ("Turbine Gates Status"=w85, "Turbines State (%)"=w86)
        $"Turbines Status" <- w85
        $"Turbines Open Gap (%)" <- w86
        w35 = default
      }
      frame "Change Inflow" {
        Variant To Data(error in (no error)=w33, type=f64 0, variant=w32) -> (data=w87, error out=w88)
        call "Set Lake Inflow.gvi"(Dam in=s1, Intake Rate (cfs)=w87, Error in=w88) -> (Dam out=w36, Intake Rate out (cfs)=w89, Error out=w34)
        # Use this case to change the inflow rate of the dam
        $"Inflow (cfs) reading" <- w89
        w35 = default
      }
      frame "ChangeTurbines Status" {
        # Use this case to change the turbines status of the dam
        w90 = cluster{"Element 1": bool[], "Element 2": f64[]} {all zero or empty}
        Variant To Data(error in (no error)=w33, type=w90, variant=w32) -> (data=w91, error out=w92)
        Property Node(instance in=w91) -> ("Element 1"=w93, "Element 2"=w94)
        call "Set Turbines Status.gvi"(Dam in=s1, Turbines Status=w93, Turbine Gates=w94, Error in=w92) -> (Dam out=w36, Turbines Status Out=w95, Turbine Gates Out=w96, Error out=w34)
        $"Turbines Status" <- w95
        $"Turbines Open Gap (%)" <- w96
        w35 = default
      }
      frame "Change Floodgates Status" {
        # Use this case to change the turbines status of the dam
        Variant To Data(error in (no error)=w33, type=T1 {all zero or empty}, variant=w32) -> (data=w97, error out=w98)
        Property Node(instance in=w97) -> ("Element 1"=w99, "Element 2"=w100)
        call "Set Floodgates Status.gvi"(Dam in=s1, Large Floodgates Status=w99, Small Floodgates Status=w100, Error in=w98) -> (Dam out=w36, Large Floodgates Status Out=w101, Small Floodgates Status Out=w102, Error out=w34)
        $"Large Floodgates Status" <- w101
        $"Small Floodgates Status" <- w102
        w35 = default
      }
      frame "Save Config File" {
        call "Write Config File.gvi"(dam.gtype out=s1, error in=w33) -> (dam.gtype in=w36, error out=w34)
        w35 = default
      }
      frame "Execute Cmd Line" {
        Variant To Data(error in (no error)=w33, type=string "", variant=w32) -> (data=w103, error out=w104)
        call "System Exec.gvi"(command line=w103, error in=w104) -> (error out=w34)
        w35 = default
        w36 = s1
      }
    }
    call "Error Check.gvi"(Message Queue In=w30, Error In=w34) -> (Error Output=w105)
    Merge Errors(w34, w105) -> (error out=w106)
    next s1 = w36
    stop if w35
  }
  call "Multiplex Errors.gvi"(error in 1=w28, error in 2=w106) -> (error out=w107)
  Unregister For Events(error in=w107, event registration refnum=w7) -> (error out=w108)
  call "Close QMH.gvi"(Message Queue=w27, Stop Event=w2, error in=w108) -> (error out=w109)
  call "Display Error.gvi"(error in=w109)
