vi "Close QMH.gvi"   [LabVIEW NXG 3.0.0]
# This VI closes the reference to the queue and suer event used in the QMH.
inputs:
  "Message Queue": Queue<"Message.gtype">, required
  "Stop Event": "event Stop Event"
  "error in": error
outputs:
  "error out": error
types:
  "Commands.gtype" = enum{"Stop"}
  "Message.gtype" = cluster{"Command": "Commands.gtype", "Variant": variant}
uses:
  NI::G Core::Error::Multiplex Errors.gvi
diagram:
  Release Queue(queue=$"Message Queue") -> (error out=w1)
  Destroy User Event(user event=$"Stop Event") -> (error out=w2)
  call "Multiplex Errors.gvi"(error in 1=$"error in", error in 2=w1, error in 3=w2) -> (error out=w3)
  $"error out" <- w3
