vi "Error Check.gvi"   [LabVIEW NXG 3.0.0]
inputs:
  "Message Queue In": Queue<"Message.gtype">, required
  "Error In": error
outputs:
  "Error Output": error
  "Message Queue Out": Queue<"Message.gtype">
types:
  "Commands.gtype" = enum{"Stop", "Update Dam", "Log", "Initialize"}
  "Message.gtype" = cluster{"Command": "Commands.gtype", "Variant": variant}
diagram:
  case ($"Error In") {
    frame No Error {
      w1 = $"Message Queue In"
      w2 = $"Error In"
    }
    frame Error {
      call "Send Message.gvi"(Queue in=$"Message Queue In", Command="Stop", Data=$"Error In") -> (Queue out=w1, Output=w3)
      Merge Errors($"Error In", w3) -> (error out=w2)
    }
  }
  $"Message Queue Out" <- w1
  $"Error Output" <- w2
