vi "Open QMH.gvi"   [LabVIEW NXG 3.0.0]
# This VI creates the message queue and user events for a Queued Message Handler
inputs:
  "error in": error
outputs:
  "Message Queue": Queue<"Message.gtype">
  "Stop Event": "event Stop Event"
  "error out": error
types:
  "Commands.gtype" = enum{"Stop"}
  "Message.gtype" = cluster{"Command": "Commands.gtype", "Variant": variant}
diagram:
  Obtain Queue(element data type="Message.gtype" {all zero or empty}, error in=$"error in") -> (error out=w1, queue out=w2)
  $"Message Queue" <- w2
  Create User Event[EventName="Stop Event"](error in=w1, user event data type=bool FALSE) -> (error out=w3, user event out=w4)  # Create User Event: Stop Event
  $"error out" <- w3
  $"Stop Event" <- w4
