vi "Read Message.gvi"   [LabVIEW NXG 3.0.0]
# this VI uses the dequeue function to read the message from the queue and return the command and data
inputs:
  "Message Queue In": Queue<"Message.gtype">, required
  "Error in": error
outputs:
  "Data": variant
  "Command": "Commands.gtype"
  "Error out": error
  "Message Queue Out": Queue<"Message.gtype">
types:
  "Commands.gtype" = enum{"Stop"}
  "Message.gtype" = cluster{"Command": "Commands.gtype", "Variant": variant}
diagram:
  Dequeue Element(error in=$"Error in", queue=$"Message Queue In") -> (element=w1, error out=w2, queue out=w3)
  $"Message Queue Out" <- w3
  Property Node(instance in=w1) -> ("Command"=w4, "Variant"=w5)
  $Command <- w4
  $Data <- w5
  $"Error out" <- w2
