vi "Send Message.gvi"   [LabVIEW NXG 3.0.0]
# This VI sends a message to the message queue
inputs:
  "Queue in": Queue<"Message.gtype">, required
  "Data": variant
  "Command": "Commands.gtype" = "Stop", required
  "Input": error
  "Priority?": bool
outputs:
  "Output": error
  "Queue out": Queue<"Message.gtype">
types:
  "Commands.gtype" = enum{"Stop"}
  "Message.gtype" = cluster{"Command": "Commands.gtype", "Variant": variant}
diagram:
  Property Node(instance in="Message.gtype" {all zero or empty}, "Command"=$Command, "Variant"=$Data) -> (instance out=w1)
  case ($"Priority?") {
    frame True {
      Enqueue Element At Opposite End(element=w1, queue=$"Queue in") -> (error out=w2, queue out=w3)
    }
    frame False {
      Enqueue Element(element=w1, queue=$"Queue in") -> (error out=w2, queue out=w3)
    }
  }
  $"Queue out" <- w3
  Merge Errors($Input, w2) -> (error out=w4)
  $Output <- w4
