vi "Update Dam and Log.gvi"   [LabVIEW NXG 3.0.0]
# This VI checks for an elapsed time to update the dam and log the dam’s data
inputs:
  "Message Queue In": Queue<"Message.gtype">, required
  "Dam Update Time": f64 = 1, required
  "Log Time": f64 = 60, required
  "Error Input": error
outputs:
  "Error Output": error
  "Message Queue Out": Queue<"Message.gtype">
types:
  "Commands.gtype" = enum{"Stop", "Update Dam", "Log", "Initialize", "Change Inflow", "ChangeTurbines Status", "Change Floodgates Status"}
  "Message.gtype" = cluster{"Command": "Commands.gtype", "Variant": variant}
uses:
  NI::G Core::Timing::Elapsed Timer.gvi
diagram:
  Is First Call() -> w1
  case ($"Error Input") {
    frame Error, Default {
      w2 = $"Error Input"
      w3 = $"Message Queue In"
    }
    frame No Error {
      call "Elapsed Timer.gvi"(target time=$"Log Time") -> (time has elapsed=w4)
      Logical Or(w4, w1) -> w5
      call "Elapsed Timer.gvi"(target time=$"Dam Update Time") -> (time has elapsed=w6)
      Logical Or(w6, w1) -> w7
      case (w7) {
        frame False, Default {
          w8 = $"Error Input"
          w9 = $"Message Queue In"
        }
        frame True {
          call "Send Message.gvi"(Queue in=$"Message Queue In", Command="Update Dam", Input=$"Error Input") -> (Queue out=w9, Output=w8)
        }
      }
      case (w5) {
        frame False, Default {
          w2 = w8
          w3 = w9
        }
        frame True {
          call "Send Message.gvi"(Queue in=w9, Command="Log", Input=w8) -> (Queue out=w3, Output=w2)
        }
      }
    }
  }
  $"Message Queue Out" <- w3
  $"Error Output" <- w2
