vi "Main.gviweb"   [LabVIEW NXG 3.0.0]
# This template is for the Queued Message Handler design pattern. The Event Handling Loop generates messages based on user interface actions. The Message Handling Loop processes messages generated by the Event Handling Loop, or by other messages. The messages are string values, so new messages can be added easily to the Message Cases case structure in the Message Handling Loop. Each message cluster can also provide an optional value for Message Data,  which is a String that can be swapped to whatever type of data is required.
panel controls:
  "Exit": bool
  "Tasks": i32
  "Clear Faults": bool
  "Robot ON/OFF": bool
  "Fail Setting": T1 = "Retry"
  "Add Tasks": i32
  "Tee Holes": bool[] = [FALSE, FALSE, FALSE, FALSE, FALSE, FALSE, FALSE, FALSE, FALSE]
  "Sand Traps": bool[] = [FALSE, FALSE, FALSE]
  "Patch All Tee Holes": bool
  "Patch Selected Tee Holes": bool
  "Rake All Sand Traps": bool
  "Rake Selected Sand Traps": bool
  "Retrieve Balls": bool
  "Reset": bool
  "Skip Current Task": bool
  "Clear Pending Tasks": bool
panel indicators:
  "Pending Tasks": string[]
  "Completed Tasks": string[]
  "Faults and alerts": string[]
  "Sequence Progress": f64
  "Robot Status": string
  "Start Time": timestamp
  "Step Progress": f64
  "URL Image": string
types:
  T1 = enum{"Retry", "Alert", "Alert and Retry", "Ignore"}
  "Robot Status.gtype" = enum{"Off", "Idle", "Running", "Paused", "Error"}
  "Task Types.gtype" = enum{"Patch Tee Hole", "Rake Sand Trap", "Retrieve Balls from Creek"}
  "Task Status.gtype" = enum{"Waiting", "Running", "Completed", "Failed", "Skipped"}
  "Task Data.gtype" = cluster{"Task Type": "Task Types.gtype", "Remaining time (s)": f64, "Status": "Task Status.gtype", "Index": u32, "Start Time": timestamp, "End Time": timestamp}
  "Robot Data.gtype" = cluster{"Start Time": timestamp, "Robot Status": "Robot Status.gtype", "Completed Tasks": "Task Data.gtype"[], "Tasks in Queue": "Task Data.gtype"[], "Alerts": error[]}
uses:
  Application::support::Message Queue::Create All Message Queues.gviweb
  Application::support::Message Queue::Dequeue Message.gviweb
  NI::G Core::Error::Build Error Cluster.gvi
  Application::Task functions::Time Constants FGV.gviweb
  Application::support::Message Queue::Enqueue Message (Single).gviweb
  Application::Task functions::Parse Compelted Tasks.gviweb
  Application::Task functions::Parse Queue of Tasks.gviweb
  Application::Robot functions::Parse Faults and Alerts.gviweb
  Application::Robot functions::Process Task.gviweb
  Application::Task functions::Create New Task.gviweb
  Application::support::Error Handler - Message Handling Loop.gviweb
  Application::support::Error Handler - Event Handling Loop.gviweb
diagram:
  w1 = bool FALSE  # Stop Event
  Create User Event[EventName="Stop Event"](user event data type=w1) -> (error out=w2, user event out=w3)
  call "Create All Message Queues.gviweb"(error in=w2) -> (message queues=w4, error out=w5)
  Property Node(instance in=w4) -> ("message queue"=w6)
  w7 = "Robot Data.gtype" {"Start Time"=1904-01-01T00:00:00Z, "Robot Status"="Idle", "Completed Tasks"=[], "Tasks in Queue"=[], "Alerts"=[]}
  s1 = w7  # shift register
  while {
    # w3: Stop Event
    # s1: Data
    call "Dequeue Message.gviweb"(message queue in=w6, error in=w5) -> (message queue out=w8, message=w9, message data=w10, error out=w11)
    case (w9) ignore case {  # Message Cases
      frame Default {
        w15 = "The invalid message string \"%s\" was received in the Message Handling Loop."
        Format Into String(formatString=w15, w9) -> w16
        call "Build Error Cluster.gvi"(code=1, description=w16) -> (error out=w12)
        w13 = s1
        w14 = default
      }
      frame "Initialize" {
        w17 = ["Patch Tee Hole", "Rake Sand Trap", "Retrieve Balls from Creek"]
        call "Time Constants FGV.gviweb"(Status=w17, Time=[5, 10, 15], Write?=TRUE)
        Get Current Time() -> (current time=w18)
        Property Node(instance in=s1, "Start Time"=w18, "Robot Status"="Off", "Completed Tasks"="Task Data.gtype"[] [], "Tasks in Queue"="Task Data.gtype"[] [], "Alerts"=error[] []) -> (instance out=w13)
        call "Enqueue Message (Single).gviweb"(message queue in=w8, message="Update Display", error in=w11) -> (error out=w12)
        $"Robot ON/OFF" <- FALSE
        w14 = default
      }
      frame "Update Display" {
        Property Node(instance in=s1) -> ("Start Time"=w19, "Robot Status"=w20, "Completed Tasks"=w21, "Tasks in Queue"=w22, "Alerts"=w23, instance out=w13)
        $"Start Time" <- w19
        call "Parse Compelted Tasks.gviweb"(Completed Tasks=w21) -> (Completed Tasks Strings=w24)
        $"Completed Tasks" <- w24
        Array Size(array=w22) -> (size(s)=w25)
        Array Size(array=w21) -> (size(s)=w26)
        Add(w26, w25) -> w27
        Divide(x=w25, y=w27) -> w28
        Subtract(x=1, y=w28) -> w29
        $"Sequence Progress" <- w29
        call "Parse Queue of Tasks.gviweb"(Tasks in Queue=w22) -> (Pending Tasks=w30, % complete=w31)
        $"Pending Tasks" <- w30
        Array Index(array=w31) -> (out0[_]=w32)
        $"Step Progress" <- w32
        call "Parse Faults and Alerts.gviweb"(Alerts=w23) -> (Faults and alerts=w33)
        $"Faults and alerts" <- w33
        Format Into String(errIn=w11, w20) -> (outString=w34, errOut=w12)
        $"Robot Status" <- w34
        w14 = default
      }
      frame "Error" {
        Property Node(instance in=s1) -> ("Alerts"=w35, instance out=w36)
        Unflatten From JSON(JSON string=w10, error in (no error)=w11, type and defaults=w11) -> (error out=w12, value=w37)
        Build Array(w35, w37) -> w38
        Property Node(instance in=w36, "Alerts"=w38) -> (instance out=w13)
        w14 = default
      }
      frame "Idle/Timeout" {
        call "Enqueue Message (Single).gviweb"(message queue in=w8, message="Update Display", error in=w11) -> (error out=w39)
        call "Process Task.gviweb"(Input info=s1, Input arguments=w10, Fail Setting=$"Fail Setting", Error In=w39) -> (Output info=w13, Error Out=w12)
        w14 = default
      }
      frame "Exit" {
        Release Queue(error in=w11, queue=w8) -> (error out=w40)
        Generate User Event(event data=TRUE, user event=w3) -> (error out=w41)
        # Stop the VI
        Merge Errors(w41, w40) -> (error out=w12)
        w13 = s1
        w14 = TRUE
      }
      frame "Turn On Robot" {
        Property Node(instance in=s1) -> ("Robot Status"=w42, instance out=w43)
        case (w42) {
          frame "Off", "Idle" {
            w44 = "Idle"
          }
          frame "Running", "Paused" {
            w44 = "Running"
          }
          frame "Error", Default {
            w44 = w42
          }
        }
        Property Node(instance in=w43, "Robot Status"=w44) -> (instance out=w13)
        call "Enqueue Message (Single).gviweb"(message queue in=w8, message="Update Display", error in=w11) -> (error out=w12)
        w14 = default
      }
      frame "Turn Off Robot" {
        Property Node(instance in=s1) -> ("Robot Status"=w45, instance out=w46)
        case (w45) {
          frame "Idle", "Running", "Paused" {
            w47 = "Paused"
          }
          frame "Off" {
            w47 = w45
          }
          frame "Error", Default {
            w47 = w45
          }
        }
        Property Node(instance in=w46, "Robot Status"=w47) -> (instance out=w13)
        call "Enqueue Message (Single).gviweb"(message queue in=w8, message="Update Display", error in=w11) -> (error out=w12)
        w14 = default
      }
      frame "Patch" {
        Property Node(instance in=s1) -> ("Tasks in Queue"=w48, instance out=w49)
        Unflatten From JSON(JSON string=w10, error in (no error)=w11, type and defaults=bool[] []) -> (error out=w12, value=w50)
        for (iteration -> i1) {
          w51 = each element of w50
          Increment(x=i1) -> w53
          call "Create New Task.gviweb"(Task Types="Patch Tee Hole", Index=w53) -> (New Task=w54)
          append w54 to w52 if w51
        }
        Build Array(w48, w52) -> w55
        Property Node(instance in=w49, "Tasks in Queue"=w55) -> (instance out=w13)
        w14 = default
      }
      frame "Rake" {
        Property Node(instance in=s1) -> ("Tasks in Queue"=w56, instance out=w57)
        Unflatten From JSON(JSON string=w10, error in (no error)=w11, type and defaults=bool[] []) -> (error out=w12, value=w58)
        for (iteration -> i2) {
          w59 = each element of w58
          Increment(x=i2) -> w61
          call "Create New Task.gviweb"(Task Types="Rake Sand Trap", Index=w61) -> (New Task=w62)
          append w62 to w60 if w59
        }
        Build Array(w56, w60) -> w63
        Property Node(instance in=w57, "Tasks in Queue"=w63) -> (instance out=w13)
        w14 = default
      }
      frame "Retrieve Balls" {
        Property Node(instance in=s1) -> ("Tasks in Queue"=w64, instance out=w65)
        call "Create New Task.gviweb"(Task Types="Retrieve Balls from Creek") -> (New Task=w66)
        Build Array(w64, w66) -> w67
        Property Node(instance in=w65, "Tasks in Queue"=w67) -> (instance out=w13)
        w12 = w11
        w14 = default
      }
      frame "Clear Alerts" {
        Property Node(instance in=s1, "Alerts"=error[] []) -> (instance out=w13)
        call "Enqueue Message (Single).gviweb"(message queue in=w8, message="Update Display", error in=w11) -> (error out=w12)
        w14 = default
      }
      frame "Skip Current Task" {
        Property Node(instance in=s1) -> ("Tasks in Queue"=w68, "Completed Tasks"=w69, instance out=w70)
        Is Empty Array(array=w68) -> w71
        case (w71) {
          frame True {
            w72 = w68
            w73 = w69
            w12 = w11
          }
          frame False {
            Delete From Array(inArray=w68) -> (outArray=w72, deleted=w74)
            Property Node(instance in=w74, "Status"="Skipped") -> (instance out=w75)
            Build Array(w69, w75) -> w73
            Property Node(instance in=w11, "status"=TRUE, "code"=5002, "source"="The running task was skipped") -> (instance out=w12)
          }
        }
        Property Node(instance in=w70, "Tasks in Queue"=w72, "Completed Tasks"=w73) -> (instance out=w13)
        w14 = default
      }
      frame "Clear Pending Tasks" {
        Property Node(instance in=s1, "Tasks in Queue"="Task Data.gtype"[] []) -> (instance out=w13)
        Property Node(instance in=w11, "status"=TRUE, "code"=5003, "source"="Pending tasks were cleared from execution") -> (instance out=w12)
        w14 = default
      }
    }
    call "Error Handler - Message Handling Loop.gviweb"(message queue in=w8, error in=w12) -> (dup error in=w76)
    next s1 = w13
    stop if w14
  }
  Register For Events("Stop Event"=w3) -> (event registration refnum out=w77)
  s2 = w77  # shift register
  while {
    event (timeout = 100) (dynamic events = s2) {
      on "Dynamic" Stop Event {
        w78 = TRUE
        w79 = no error
        w80 = w6
      }
      on "Exit" Value changed {
        call "Enqueue Message (Single).gviweb"(priority message=TRUE, message queue in=w6, message="Exit") -> (message queue out=w80, error out=w79)
        w78 = default
      }
      on Timeout {
        Get Current Time() -> (current time=w81)
        Time Stamp To Double Precision Float(number=w81) -> (double precision float=w82)
        Number To Fractional String(number=w82, precision (6)=20) -> (F-format string=w83)
        call "Enqueue Message (Single).gviweb"(message queue in=w6, message="Idle/Timeout", message data=w83) -> (message queue out=w80, error out=w79)
        w78 = default
      }
      on "Robot ON/OFF" Value changed {
        Select(s=$"Robot ON/OFF", t="Turn On Robot", f="Turn Off Robot") -> w84
        call "Enqueue Message (Single).gviweb"(message queue in=w6, message=w84) -> (message queue out=w80, error out=w79)
        w78 = default
      }
      on "Clear Faults" Value changed {
        call "Enqueue Message (Single).gviweb"(message queue in=w6, message="Clear Alerts") -> (message queue out=w80, error out=w79)
        w78 = default
      }
      on "Patch All Tee Holes" Value changed; "Patch Selected Tee Holes" Value changed {
        Array Size(array=$"Tee Holes") -> (size(s)=w85)
        Initialize Array(element=TRUE, size=w85) -> w86
        Select(s=$"Patch All Tee Holes", t=w86, f=$"Tee Holes") -> w87
        Flatten To JSON(anything=w87) -> (JSON string=w88, error out=w89)
        call "Enqueue Message (Single).gviweb"(message queue in=w6, message="Patch", message data=w88, error in=w89) -> (message queue out=w80, error out=w79)
        w78 = default
      }
      on "Rake All Sand Traps" Value changed; "Rake Selected Sand Traps" Value changed {
        Array Size(array=$"Sand Traps") -> (size(s)=w90)
        Initialize Array(element=TRUE, size=w90) -> w91
        Select(s=$"Rake All Sand Traps", t=w91, f=$"Sand Traps") -> w92
        Flatten To JSON(anything=w92) -> (JSON string=w93, error out=w94)
        call "Enqueue Message (Single).gviweb"(message queue in=w6, message="Rake", message data=w93, error in=w94) -> (message queue out=w80, error out=w79)
        w78 = default
      }
      on "Retrieve Balls" Value changed {
        call "Enqueue Message (Single).gviweb"(message queue in=w6, message="Retrieve Balls") -> (message queue out=w80, error out=w79)
        w78 = default
      }
      on "Reset" Value changed {
        call "Enqueue Message (Single).gviweb"(message queue in=w6, message="Initialize") -> (message queue out=w80, error out=w79)
        w78 = default
      }
      on "Clear Pending Tasks" Value changed {
        call "Enqueue Message (Single).gviweb"(message queue in=w6, message="Clear Pending Tasks") -> (message queue out=w80, error out=w79)
        w78 = default
      }
      on "Skip Current Task" Value changed {
        call "Enqueue Message (Single).gviweb"(message queue in=w6, message="Skip Current Task") -> (message queue out=w80, error out=w79)
        w78 = default
      }
    }
    call "Error Handler - Event Handling Loop.gviweb"(message queue in=w80, error in=w79) -> (dup error in=w95)
    stop if w78
  }
  Unregister For Events(error in=w95, event registration refnum=s2) -> (error out=w96)
  Property Node(instance in=s1) -> ("Alerts"=w97)
  Merge Errors(w96, w76, w97) -> (error out=w98)
  Destroy User Event(error in=w98, user event=w3)
