vi "Parse Faults and Alerts.gviweb"   [LabVIEW NXG 3.0.0]
# Converts faults and alerts from an error cluster array to an array of strings
inputs:
  "Alerts": error[], required
outputs:
  "Faults and alerts": string[]
diagram:
  for {
    w1 = each element of $Alerts
    Property Node(instance in=w1) -> ("status"=w3, "code"=w4, "source"=w5)
    Number To Decimal String(number=w4) -> (decimal integer string=w6)
    Select(s=w3, t="Error", f="Warning") -> w7
    Concatenate Strings(w7, " #", w6, ": ", w5) -> w8
    append w8 to w2
  }
  $"Faults and alerts" <- w2
