vi "Process Task.gviweb"   [LabVIEW NXG 3.0.0]
# Execute this VI as fast as possible for the robot to process the task on hand.
inputs:
  "Input arguments": string
  "Input info": "Robot Data.gtype" = {"Start Time"=1904-01-01T00:00:00Z, "Robot Status"="Idle", "Completed Tasks"=[], "Tasks in Queue"=[], "Alerts"=[]}, required
  "Error In": error
  "Fail Setting": T1 = "Retry"
outputs:
  "Output info": "Robot Data.gtype"
  "Error Out": error
types:
  "Robot Status.gtype" = enum{"Off", "Idle", "Running", "Paused", "Error"}
  "Task Types.gtype" = enum{"Patch Tee Hole", "Rake Sand Trap", "Retrieve Balls from Creek"}
  "Task Status.gtype" = enum{"Waiting", "Running", "Completed", "Failed", "Skipped"}
  "Task Data.gtype" = cluster{"Task Type": "Task Types.gtype", "Remaining time (s)": f64, "Status": "Task Status.gtype", "Index": u32, "Start Time": timestamp, "End Time": timestamp}
  "Robot Data.gtype" = cluster{"Start Time": timestamp, "Robot Status": "Robot Status.gtype", "Completed Tasks": "Task Data.gtype"[], "Tasks in Queue": "Task Data.gtype"[], "Alerts": error[]}
  T1 = enum{"Retry", "Alert", "Alert and Retry", "Ignore"}
uses:
  Application::Task functions::Perform Task.gviweb
  Application::Task functions::Reset Task.gviweb
diagram:
  # LOGIC:
  # If the robot is off, then process nothing and update the time of the running task.
  # If the robot is on:
  # 	If there are no tasks: IDLE
  # 	If there are tasks: Process the task.
  # 		Subtract the time remaining from the task.
  # 			If the task has no more time remaining:
  # 				If it completed successfully then change it to completed tasks
  # 				Else, read setting to alert or retry and take action
  case ($"Error In") {
    frame Error, Default {
      w1 = $"Error In"
      w2 = $"Input info"
    }
    frame No Error {
      Property Node(instance in=$"Input info") -> ("Robot Status"=w3, "Completed Tasks"=w4, "Tasks in Queue"=w5, instance out=w6)
      Floating Point String To Number(string=$"Input arguments") -> (number=w7)
      To Time Stamp(number=w7) -> w8
      case (w3) {
        frame Default {
          Is Empty Array(array=w5) -> w12
          # Robot stopped
          case (w12) {
            frame False, Default {
              # Update pending tasks
              Array Index(array=w5) -> (out0[0]=w13)
              Property Node(instance in=w13, "End Time"=w8) -> (instance out=w14)
              Replace Array Subset(inArray=w5, index=0, new=w14) -> w11
            }
            frame True {
              # No pending tasks
              w11 = w5
            }
          }
          w9 = w3
          w10 = w4
          w1 = $"Error In"
        }
        frame "Idle", "Running" {
          Is Empty Array(array=w5) -> w15
          # Robot running
          case (w15) {
            frame False, Default {
              # There is a pending task
              Array Index(array=w5) -> (out0[0]=w16)
              call "Perform Task.gviweb"(Task In=w16, Current Time=w8, Input=$"Error In") -> (Task Out=w17, Is task done?=w18, Failed?=w19, Output=w20)
              Replace Array Subset(inArray=w5, index=0, new=w17) -> w21
              case (w18) {
                frame False, Default {
                  # The task has not completed
                  w11 = w21
                  w10 = w4
                  w1 = w20
                }
                frame True {
                  # The task completed
                  # The task failed
                  case ($"Fail Setting") {
                    frame "Retry" {
                      w22 = default
                      w23 = TRUE
                    }
                    frame "Alert" {
                      w22 = TRUE
                      w23 = default
                    }
                    frame "Alert and Retry" {
                      w22 = TRUE
                      w23 = TRUE
                    }
                    frame "Ignore", Default {
                      w22 = default
                      w23 = default
                    }
                  }
                  Logical And(w23, w19) -> w24
                  case (w24) {
                    frame False, Default {
                      Delete From Array(inArray=w21, index0=0) -> (outArray=w11, deleted=w25)
                      # No retry / succeeded
                      Build Array(w4, w25) -> w10
                    }
                    frame True {
                      Array Index(array=w21) -> (out0[0]=w26)
                      call "Reset Task.gviweb"(element=w26) -> (new element/subarray=w27)
                      # Retry
                      Replace Array Subset(inArray=w21, index=0, new=w27) -> w11
                      w10 = w4
                    }
                  }
                  Logical And(w22, w19) -> w28
                  case (w28) {
                    frame False, Default {
                      w1 = w20
                    }
                    frame True {
                      Array Index(array=w21) -> (out0[_]=w29)
                      Property Node(instance in=w29) -> ("Task Type"=w30, "Index"=w31)
                      Format Into String(errIn=w20, w30) -> (outString=w32, errOut=w33)
                      Number To Decimal String(number=w31) -> (decimal integer string=w34)
                      Concatenate Strings(" # ", w34) -> w35
                      Is Equal To 0(x=w31) -> w36
                      Select(s=w36, t="", f=w35) -> w37
                      Concatenate Strings("Failed to execute task: ", w32, w37) -> w38
                      # Alert
                      Property Node(instance in=w33, "status"=TRUE, "code"=5001, "source"=w38) -> (instance out=w1)
                    }
                  }
                }
              }
              w9 = "Running"
            }
            frame True {
              # There are no pending tasks
              w10 = w4
              w9 = "Idle"
              w11 = w5
              w1 = $"Error In"
            }
          }
        }
      }
      Property Node(instance in=w6, "Robot Status"=w9, "Completed Tasks"=w10, "Tasks in Queue"=w11) -> (instance out=w2)
    }
  }
  $"Output info" <- w2
  $"Error Out" <- w1
