vi "Create New Task.gviweb"   [LabVIEW NXG 3.0.0]
# This VI returns a new task configured accordingly to the class type
inputs:
  "Task Types": "Task Types.gtype" = "Patch Tee Hole"
  "Index": u32
outputs:
  "New Task": "Task Data.gtype"
types:
  "Task Types.gtype" = enum{"Patch Tee Hole", "Rake Sand Trap", "Retrieve Balls from Creek"}
  "Task Status.gtype" = enum{"Waiting", "Running", "Completed", "Failed"}
  "Task Data.gtype" = cluster{"Task Type": "Task Types.gtype", "Remaining time (s)": f64, "Status": "Task Status.gtype", "Index": u32, "Start Time": timestamp, "End Time": timestamp}
uses:
  Application::Task functions::Get Task Type Time.gviweb
diagram:
  call "Get Task Type Time.gviweb"(Task Type=$"Task Types") -> (Task time (s)=w1)
  Property Node(instance in="Task Data.gtype" {all zero or empty}, "Task Type"=$"Task Types", "Remaining time (s)"=w1, "Status"="Waiting", "Index"=$Index) -> (instance out=w2)
  $"New Task" <- w2
