vi "Get Task Type Time.gviweb"   [LabVIEW NXG 3.0.0]
# Returns the time of a task, depending on its type.
inputs:
  "Task Type": "Task Types.gtype" = "Patch Tee Hole", required
outputs:
  "Task time (s)": f64
types:
  "Task Types.gtype" = enum{"Patch Tee Hole", "Rake Sand Trap", "Retrieve Balls from Creek"}
uses:
  Application::Task functions::Time Constants FGV.gviweb
diagram:
  call "Time Constants FGV.gviweb"() -> (Status Out=w1, Time Out=w2)
  Search 1D Array(1D array=w1, element=$"Task Type") -> (index of element=w3)
  Array Index(array=w2) -> (out0[w3]=w4)
  $"Task time (s)" <- w4
