vi "Parse Compelted Tasks.gviweb"   [LabVIEW NXG 3.0.0]
# Use this VI to parse completed tasks to an array of strings that can be shown in the front panel.
inputs:
  "Completed Tasks": "Task Data.gtype"[], required
outputs:
  "Completed Tasks Strings": string[]
types:
  "Task Types.gtype" = enum{"Patch Tee Hole", "Rake Sand Trap", "Retrieve Balls from Creek"}
  "Task Status.gtype" = enum{"Waiting", "Running", "Completed", "Failed", "Skipped"}
  "Task Data.gtype" = cluster{"Task Type": "Task Types.gtype", "Remaining time (s)": f64, "Status": "Task Status.gtype", "Index": u32, "Start Time": timestamp, "End Time": timestamp}
diagram:
  for {
    w1 = each element of $"Completed Tasks"
    Property Node(instance in=w1) -> ("Task Type"=w3, "Index"=w4, "Status"=w5, "End Time"=w6)
    Format Into String(w3) -> w7
    Get Date And Time String(time stamp=w6) -> (time string=w8)
    Is Equal To 0(x=w4) -> w9
    Number To Decimal String(number=w4) -> (decimal integer string=w10)
    Concatenate Strings(" #", w10) -> w11
    Select(s=w9, t="", f=w11) -> w12
    Format Into String(w5) -> w13
    Concatenate Strings(w7, w12, " ", w13, " at ", w8) -> w14
    append w14 to w2
  }
  $"Completed Tasks Strings" <- w2
