vi "Parse Queue of Tasks.gviweb"   [LabVIEW NXG 3.0.0]
# Use this VI to parse tasks in the queue to an array of strings that can be shown in the front panel.
inputs:
  "Tasks in Queue": "Task Data.gtype"[], required
outputs:
  "Pending Tasks": string[]
  "% complete": f64[]
types:
  "Task Types.gtype" = enum{"Patch Tee Hole", "Rake Sand Trap", "Retrieve Balls from Creek"}
  "Task Status.gtype" = enum{"Waiting", "Running", "Completed", "Failed"}
  "Task Data.gtype" = cluster{"Task Type": "Task Types.gtype", "Remaining time (s)": f64, "Status": "Task Status.gtype", "Index": u32, "Start Time": timestamp, "End Time": timestamp}
uses:
  Application::Task functions::Get Task Type Time.gviweb
diagram:
  Is Empty Array(array=$"Tasks in Queue") -> w1
  for {
    w2 = each element of $"Tasks in Queue"
    Property Node(instance in=w2) -> ("Task Type"=w5, "Index"=w6, "Remaining time (s)"=w7)
    Format Into String(w5) -> w8
    Number To Decimal String(number=w6) -> (decimal integer string=w9)
    Concatenate Strings(" # ", w9) -> w10
    Is Equal To 0(x=w6) -> w11
    Select(s=w11, t="", f=w10) -> w12
    call "Get Task Type Time.gviweb"(Task Type=w5) -> (Task time (s)=w13)
    Divide(x=w7, y=w13) -> w14
    Multiply(w14, 100) -> w15
    Subtract(x=100, y=w15) -> w16
    Number To Fractional String(number=w16, precision (6)=2) -> (F-format string=w17)
    Number To Fractional String(number=w7, precision (6)=2) -> (F-format string=w18)
    Concatenate Strings(w8, w12, " is ", w17, "% complete to finish in ", w18, " seconds.") -> w19
    append w19 to w3
    append w16 to w4
  }
  Select(s=w1, t=[0], f=w4) -> w20
  $"% complete" <- w20
  $"Pending Tasks" <- w3
