vi "Perform Task.gviweb"   [LabVIEW NXG 3.0.0]
# Call this VI to perform a task. The VI will compare the last time that the function was called and will determine if the task is done or not. It will also return the updated task
inputs:
  "Task In": "Task Data.gtype", required
  "Input": error
  "Current Time": timestamp
outputs:
  "Task Out": "Task Data.gtype"
  "Is task done?": bool
  "Output": error
  "Failed?": bool
types:
  "Task Types.gtype" = enum{"Patch Tee Hole", "Rake Sand Trap", "Retrieve Balls from Creek"}
  "Task Status.gtype" = enum{"Waiting", "Running", "Completed", "Failed"}
  "Task Data.gtype" = cluster{"Task Type": "Task Types.gtype", "Remaining time (s)": f64, "Status": "Task Status.gtype", "Index": u32, "Start Time": timestamp, "End Time": timestamp}
uses:
  Application::Task functions::Task Pass-Fail.gviweb
diagram:
  # LOGIC:
  # 1. Get the task type and determine the time it should run.
  # 2. Compare the previous time with the new time.
  # 3. Remove the delta from the remaining time.
  # 4. If the remaining time <= 0, then set the task as completed or failed depending on the random generator
  case ($Input) {
    frame Error, Default {
      w1 = $Input
      w2 = $"Task In"
      w3 = FALSE
      w4 = default
    }
    frame No Error {
      Property Node(instance in=$"Task In") -> ("Remaining time (s)"=w5, "Status"=w6, "Start Time"=w7, "End Time"=w8, instance out=w9)
      case (w6) {
        frame Default {
          w10 = w7
          w11 = w8
        }
        frame "Waiting" {
          # First iteration is discarded
          # because end time does not
          # make sense
          Get Current Time() -> (current time=w10)
          w11 = $"Current Time"
        }
      }
      Time Stamp Subtract(x=$"Current Time", y=w11) -> w12
      Subtract(x=w5, y=w12) -> w13
      Is Less Or Equal To 0(x=w13) -> w3
      case (w3) {
        frame False, Default {
          w14 = w13
          w15 = "Running"
          w4 = default
        }
        frame True {
          call "Task Pass-Fail.gviweb"(Fail rate (%)=10) -> (Pass?=w16)
          Not(x=w16) -> w4
          Select(s=w16, t="Completed", f="Failed") -> w15
          w14 = 0
        }
      }
      Property Node(instance in=w9, "Remaining time (s)"=w14, "Status"=w15, "End Time"=$"Current Time", "Start Time"=w10) -> (instance out=w2)
      w1 = $Input
    }
  }
  $Output <- w1
  $"Failed?" <- w4
  $"Task Out" <- w2
  $"Is task done?" <- w3
