vi "Reset Task.gviweb"   [LabVIEW NXG 3.0.0]
inputs:
  "element": "Task Data.gtype"
outputs:
  "new element/subarray": "Task Data.gtype"
types:
  "Task Types.gtype" = enum{"Patch Tee Hole", "Rake Sand Trap", "Retrieve Balls from Creek"}
  "Task Status.gtype" = enum{"Waiting", "Running", "Completed", "Failed"}
  "Task Data.gtype" = cluster{"Task Type": "Task Types.gtype", "Remaining time (s)": f64, "Status": "Task Status.gtype", "Index": u32, "Start Time": timestamp, "End Time": timestamp}
uses:
  Application::Task functions::Get Task Type Time.gviweb
diagram:
  Property Node(instance in=$element) -> ("Task Type"=w1, "Index"=w2, "Start Time"=w3, instance out=w4)
  call "Get Task Type Time.gviweb"(Task Type=w1) -> (Task time (s)=w5)
  Property Node(instance in=w4, "Task Type"=w1, "Remaining time (s)"=w5, "Status"="Waiting", "Index"=w2, "Start Time"=w3, "End Time"=w3) -> (instance out=w6)
  $"new element/subarray" <- w6
