vi "Task Pass-Fail.gviweb"   [LabVIEW NXG 3.0.0]
# Decides if a task passes or failsd based on an input rate. Uses a random number generator to determine it.
inputs:
  "Fail rate (%)": f64 = 10
outputs:
  "Pass?": bool
diagram:
  Random Number() -> (number (0 to 1)=w1)
  Divide(x=$"Fail rate (%)", y=100) -> w2
  Is Greater Or Equal(x=w1, y=w2) -> w3
  $"Pass?" <- w3
