vi "Check Loop Error.gviweb"   [LabVIEW NXG 3.0.0]
# Check the 'error to process' to see if its code value matches any of the values in the 'Ignore Errors' array. If so, do nothing. If not, send an "Error" message containing the error data to the Message Handling Loop for further processing. If the "Exit on Error?" input is TRUE, send an "Exit" message to the Message Handling Loop instead.
inputs:
  "message queue in": Queue<"Message Cluster.gtype">, required
  "error to process": error, required
  "ignore errors": i32[]
  "exit on error": bool
outputs:
  "message queue out": Queue<"Message Cluster.gtype">
  "error": bool
types:
  "QMH Commands.gtype" = enum{"Initialize", "Update Display", "Idle/Timeout", "Error", "Exit", "Turn On Robot", "Turn Off Robot", "Patch", "Rake", "Retrieve Balls", "Clear Alerts"}
  "Message Cluster.gtype" = cluster{"Message": "QMH Commands.gtype", "Message Data": string}
uses:
  NI::G Core::Error::Read Error Code.gvi
  Application::support::Message Queue::Enqueue Message (Single).gviweb
diagram:
  $"message queue out" <- $"message queue in"
  case ($"error to process") {
    frame Error {
      call "Read Error Code.gvi"(error in=$"error to process") -> (code=w2)
      Search 1D Array(1D array=$"ignore errors", element=w2) -> (index of element=w3)
      case (w3) {  # Is error in the Ignore Errors list?
        frame -1 {
          # #CodeRecommended - If you ever change the name of your "Error" or "Exit" message, you'll need to update the name of the message here.
          w4 = "Error"  # QMH Commands
          w5 = "Exit"  # QMH Commands
          Select(s=$"exit on error", t=w5, f=w4) -> w6
          # $"exit on error": Send 'Exit' as priority message
          Flatten To JSON(anything=$"error to process") -> (JSON string=w7, error out=w8)
          call "Enqueue Message (Single).gviweb"(priority message=$"exit on error", message queue in=$"message queue in", message=w6, message data=w7, error in=w8)
          w1 = TRUE
        }
        frame Default {
          w1 = FALSE
        }
      }
    }
    frame No Error {
      # No error
      w1 = FALSE
    }
  }
  $error <- w1
