vi "Error Handler - Event Handling Loop.gviweb"   [LabVIEW NXG 3.0.0]
# Process an error that occurred in the Event Handling Loop, either by ignoring it, or generating an "Error" message.
inputs:
  "message queue in": Queue<"Message Cluster.gtype">, required
  "ignore errors (runtime)": i32[]
  "error in": error
outputs:
  "message queue out": Queue<"Message Cluster.gtype">
  "dup error in": error
types:
  "QMH Commands.gtype" = enum{"Initialize", "Update Display", "Idle", "Error", "Exit"}
  "Message Cluster.gtype" = cluster{"Message": "QMH Commands.gtype", "Message Data": string}
uses:
  Application::support::Check Loop Error.gviweb
diagram:
  # #CodeRecommended - Add errors to the array as follows:
  #
  # Ignore Errors - Do nothing. Discard the error completely.
  #
  # All other errors are treated as regular errors and are sent as "Error" messages to the Message Handling Loop for further processing.
  $"dup error in" <- $"error in"
  w1 = i32[] []  # Ignore Errors (Static List)
  # The Ignore Errors (Static List) array constant should contain ignore errors that are defined at edit time. The Ignore Errors (Runtime) array can be dynamically generated at runtime.
  # Error Handler for the Event Handling Loop
  Build Array(w1, $"ignore errors (runtime)") -> w2
  call "Check Loop Error.gviweb"(message queue in=$"message queue in", error to process=$"error in", ignore errors=w2)
  $"message queue out" <- $"message queue in"
