vi "Create All Message Queues.gviweb"   [LabVIEW NXG 3.0.0]
# This VI creates and initializes all the message queues for your application. If your application requires more than one message queue, right-click the "Message Queues" constant above and select Open Type Def. Add the new Message Queue(s) to the type definition, then initialize them in this VI.
inputs:
  "error in": error
outputs:
  "message queues": cluster{"UI": Queue<T1>}
  "error out": error
types:
  T1 = cluster{"Message": string, "Message Data": string}
uses:
  Application::support::Message Queue::Obtain Message Queue.gviweb
  Application::support::Message Queue::Enqueue Message (Single).gviweb
diagram:
  # This VI creates and initializes all the message queues for your application. If your application requires more than one message queue, right-click the "Message Queues" constant above and select Open Type Def.  Add the new Message Queue(s) to the type definition, then initialize them in this VI.
  case ($"error in") {
    frame No Error {
      call "Obtain Message Queue.gviweb"(error in=$"error in") -> (message queue=w3, error out=w4)
      Property Node(instance in=cluster{"UI": Queue<T1>} {all zero or empty}, "UI"=w3) -> (instance out=w2)
      call "Enqueue Message (Single).gviweb"(message queue in=w3, message="Initialize", error in=w4) -> (error out=w1)
    }
    frame Error {
      w1 = $"error in"
      w2 = default
    }
  }
  $"message queues" <- w2
  $"error out" <- w1
