vi "Dequeue Message.gviweb"   [LabVIEW NXG 3.0.0]
# This VI pulls messages off the Message Queue.
inputs:
  "message queue in": Queue<"Message Cluster.gtype">, required
  "error in": error
outputs:
  "message queue out": Queue<"Message Cluster.gtype">
  "message": "QMH Commands.gtype"
  "message data": string
  "error out": error
types:
  "QMH Commands.gtype" = enum{"Initialize", "Update Display", "Idle", "Error", "Exit"}
  "Message Cluster.gtype" = cluster{"Message": "QMH Commands.gtype", "Message Data": string}
diagram:
  Dequeue Element(queue=$"message queue in") -> (element=w1, error out=w2, queue out=w3)
  $"message queue out" <- w3
  Property Node(instance in=w1) -> ("Message"=w4, "Message Data"=w5)
  $message <- w4
  $"message data" <- w5
  # This VI pulls messages off the Message Queue. It will dequeue messages regardless of incoming error.
  Merge Errors($"error in", w2) -> (error out=w6)
  $"error out" <- w6
