vi "Enqueue Message (Single).gviweb"   [LabVIEW NXG 3.0.0]
# For a regular message, enqueue the message. For a priority message, enqueue it at the front of the queue.
inputs:
  "message queue in": Queue<"Message Cluster.gtype">, required
  "message": "QMH Commands.gtype" = "Initialize", required
  "message data": string
  "error in": error
  "priority message": bool
outputs:
  "message queue out": Queue<"Message Cluster.gtype">
  "error out": error
types:
  "QMH Commands.gtype" = enum{"Initialize", "Update Display", "Idle", "Error", "Exit"}
  "Message Cluster.gtype" = cluster{"Message": "QMH Commands.gtype", "Message Data": string}
diagram:
  $"message queue out" <- $"message queue in"
  Property Node(instance in="Message Cluster.gtype" {all zero or empty}, "Message"=$message, "Message Data"=$"message data") -> (instance out=w1)
  # For a regular message, enqueue the message.  For a priority message, enqueue it at the front of the queue.
  case ($"priority message") {
    frame False, Default {
      Enqueue Element(element=w1, error in=$"error in", queue=$"message queue in") -> (error out=w2)
    }
    frame True {
      Enqueue Element At Opposite End(element=w1, error in=$"error in", queue=$"message queue in") -> (error out=w2)
    }
  }
  $"error out" <- w2
